# Grasshopper definition NotTrueFlow-defaultmetrics_v2.gh (Grasshopper 1.0.7)

# ----
# Create a Building by Dragonfly
panel = Panel("12.5")
rectangle = Rectangle(Plane=PlaneXY(0, 0, 0), XSize=panel, YSize=panel, Radius=0)  # -> Rectangle, Length
Z = UnitZ(Factor=Slider(15, range=15..45))
extr = Extrude(Base=rectangle.Rectangle, Direction=Z)
cap = CapHoles(Brep=extr)
buildingsolid = DFBuildingFromSolid(bldg_geo=flatten(cap), floor_to_floor="@3", perim_offset="3", run=Toggle(True))  # -> report, buildings; plug-in component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
model = DFModel(buildings=flatten(buildingsolid.buildings))  # -> report, model; plug-in component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

# ----
# To HB model
toggle = BooleanToggle(False)
tohoneybee = DFModelToHoneybee(model=model.model, use_multiplier=toggle, run=Toggle(True))  # -> report, hb_models; plug-in component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

# ----
# Add Glazings
deconstructmodel = HBDeconstructModel(model=tohoneybee.hb_models)  # -> rooms, faces, apertures, doors, shades; plug-in component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
aperturesbyratio = HBAperturesByRatio(
    hb_objs=flatten(deconstructmodel.rooms),
    ratio=Slider(0.4, range=0.1..0.9),
    subdivide=Toggle(True),
    win_height="2.5",
    sill_height="0.2",
    operable=Toggle(True))  # -> report, hb_objs; plug-in component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

decnstrobj = HBDeconstructObject(hb_obj=aperturesbyratio.hb_objs)  # -> faces, apertures, doors, shades; plug-in component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
python = HBモデルチェック(data=decnstrobj.apertures)  # -> names, normals; inputs data: list
# ---------- python: Python ----------
import rhinoscriptsyntax as rs
names = None
normals = None
names = []
normals = []

if data:
    for d in data:
        name = d.display_name
        names.append(name)
        normal = d.normal
        normals.append(normal)
# ---------- end python ----------

# ----
# Add AirBoundary
vizbytype = HBVisualizeByType(hb_objs=aperturesbyratio.hb_objs)  # -> walls, interior_walls, roofs, ceilings, exterior_floors, interior_floors, air_walls, apertures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; plug-in component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
geo = Geometry(vizbytype.interior_walls)
guidesurface = HBPropertiesByGuideSurface(rooms=aperturesbyratio.hb_objs, guide=geo, type="AirBoundary")  # -> rooms; plug-in component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

panel_2 = Panel(python.names)
vizbytype_2 = HBVisualizeByType(hb_objs=guidesurface)  # -> walls, interior_walls, roofs, ceilings, exterior_floors, interior_floors, air_walls, apertures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; plug-in component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
# Assing Window Ventilation
# Control Strategy
geo_2 = Geometry(vizbytype_2.wire_frame)

applysetpointvals = HBApplySetpointValues(room_or_program=flatten(guidesurface), cooling_setpt="60")  # -> report, mod_obj; plug-in component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
ventcontrol = HBVentilationControl(min_in_temp="23")  # -> vent_cntrl; plug-in component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
windowopen = HBWindowOpening(rooms=flatten(applysetpointvals.mod_obj), vent_cntrl=ventcontrol)  # -> report, rooms; plug-in component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

# ----
# Setup the Model with the Airflow Network
panel_3 = Panel("NotTrueFlow")
model_2 = HBModel(rooms=flatten(windowopen.rooms), name=panel_3)  # -> report, model; plug-in component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
afn = HBAirflowNewtwork(model=model_2.model, high_rise=Toggle(True))  # -> report, model; plug-in component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

analysisperiod = LBAnalysisPeriod(start_month="6", start_day=1, start_hour=0, end_month="7")  # -> period, hoys, dates; plug-in component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

toggle_2 = BooleanToggle(True)
simoutput = HBSimulationOutput(gains_and_losses=toggle_2, comfort_metrics=toggle_2)  # -> report, sim_output; plug-in component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
afn_flow = Text(["AFN Linkage Node 1 to Node 2 Volume Flow Rate", "AFN Linkage Node 2 to Node 1 Volume Flow Rate"])
customoutput = HBCustomSimulationOutput(base_sim_output=simoutput.sim_output, output_names=afn_flow)  # -> report, sim_output; plug-in component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
simpar = HBSimulationParameter(north="0", output=customoutput.sim_output, run_period=analysisperiod.period, timestep=6)  # -> sim_par; plug-in component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

# ----
# EPW
panel_4 = Panel("C:\Users\kenta\Desktop\TrueFlow\TrueFlow\gh_files\TrueFlow\Tokyo_EA2010StandardYear_ver2.epw")
toggle_3 = BooleanToggle(True)
panel_5 = Panel("2")
modeltoosm = HBModelToOSM(model=afn.model, epw_file=panel_4, sim_par=simpar, write=toggle_3, run=toggle_3)  # -> report, jsons, osw, osm, idf, sql, zsz, rdd, html; plug-in component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

# ----
# Net Airflow
bang = ExplodeTree(Data=graft(Tree({0;0}: ["AFN Linkage Node 1 to Node 2 Volume Flow Rate"], {0;1}: ["AFN Linkage Node 2 to Node 1 Volume Flow Rate"])))  # -> Branch0, Branch1
customresult = HBReadCustomResult(sql=modeltoosm.sql, output_names=bang.Branch1)  # -> results; plug-in component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
customresult_2 = HBReadCustomResult(sql=modeltoosm.sql, output_names=bang.Branch0)  # -> results; plug-in component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
xdata = LBDeconstructData(data=customresult)  # -> header, values; plug-in component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
xdata_2 = LBDeconstructData(data=customresult_2)  # -> header, values; plug-in component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
subtraction = Subtraction(A=xdata_2.values, B=xdata.values)

# ----
# Filter surfaces
decnstrobj_2 = HBDeconstructObject(hb_obj=windowopen.rooms)  # -> faces, apertures, doors, shades; plug-in component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
filter = GhPythonScript(faces=flatten([decnstrobj_2.faces, decnstrobj_2.apertures, decnstrobj_2.doors]), header=xdata_2.header)  # -> surfaces, AFN_header; inputs faces: list, header: list
# ---------- filter: Python ----------
"""Filters and sorts airflow surfaces based on the airflow data headers.
    Inputs:
        faces: Deconstructed faces from honeybee.
        airflow: The string of face identifiers from airflow network results.
    Output:
        surfaces: The sorted list of surfaces that contain airflow data"""

__author__ = "kenta"
__version__ = "2021.10.26"

# Read surface names from AFN header
AFN_header = [header[i].metadata['System'] for i in range(len(header))]

# Filter only surfaces with airflow results
surfaces = []
srf_ID = []
for face in faces:
    face_id = face.identifier.upper()
    if face_id in AFN_header:
        surfaces.append(face)
        srf_ID.append(face_id)
#print(len(faces))
#print(len(face_id))
#print(len(AFN_header))
#print(face_id)

# Sort surfaces to match AFN results
index = []
for id in AFN_header:
    index.append(srf_ID.index(id))
surfaces = [surfaces[i] for i in index]
# ---------- end filter ----------

# ----
# Center
pt = Point(Point(23.29310325, 5.727069949, 0))

# ----
# North
north = Data(0)

# ----
# Pick time
number_slider = Slider(6, range=1..12)

hoy = LBCalculateHOY(month=number_slider, day=Slider(15, range=1..31), hour=Slider(15, range=0..23))  # -> flatten(hoy), flatten(doy), flatten(date); plug-in component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
item = ListItem(List=analysisperiod.hoys, Index=0, Wrap=True)
subtraction_2 = Subtraction(A=hoy.hoy, B=item)
item_2 = ListItem(List=subtraction, Index=subtraction_2, Wrap=True)  # -> flatten(Item)

# ----
# Wind Direction Display
scale = Slider(1, range=0..1)
wind_direction = WindDirection(hoy=hoy.hoy, B=scale, north=north, epw_file=panel_4)  # -> R, C
compass = LBCompass(north=north, center=pt, scale=Slider(0.25, range=0..1))  # -> compass; plug-in component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
vdisex = VectorDisplayEx(Point=pt, Vector=wind_direction.R, Colour=wind_direction.C, Width=5)

# ----
# Normal Vector to Surface
normals = GhPythonScript(hb_objs=filter.surfaces)  # -> points, vectors; inputs hb_objs: list
# ---------- normals: Python ----------
__author__ = "kenta"
__version__ = "2022.05.21"

# Rewrote Visual Normals to not include subsurfaces

try:  # import the core honeybee dependencies
    from honeybee.model import Model
    from honeybee.room import Room
    from honeybee.face import Face
    from honeybee.aperture import Aperture
    from honeybee.door import Door
    from honeybee.shade import Shade
except ImportError as e:
    raise ImportError('\nFailed to import honeybee:\n\t{}'.format(e))

try:  # import the ladybug_rhino dependencies
    from ladybug_rhino.fromgeometry import from_point3d, from_vector3d
    from ladybug_rhino.grasshopper import all_required_inputs
except ImportError as e:
    raise ImportError('\nFailed to import ladybug_rhino:\n\t{}'.format(e))


def add_door(door, points, vectors):
    """Add Door normals."""
    points.append(from_point3d(door.center))
    vectors.append(from_vector3d(door.normal))
    for shd in door.shades:
        points.append(from_point3d(shd.center))
        vectors.append(from_vector3d(shd.normal))

def add_aperture(aperture, points, vectors):
    """Add Aperture normals."""
    points.append(from_point3d(aperture.center))
    vectors.append(from_vector3d(aperture.normal))
    for shd in aperture.shades:
        points.append(from_point3d(shd.center))
        vectors.append(from_vector3d(shd.normal))

def add_face(face, points, vectors):
    """Add Face normals.
    Modified to only include face normals and not aperatures or doors"""
    points.append(from_point3d(face.center))
    vectors.append(from_vector3d(face.normal))

def add_room(room, points, vectors):
    """Add Room normals."""
    for face in room.faces:
        add_face(face, points, vectors)
    for shd in room.shades:
        points.append(from_point3d(shd.center))
        vectors.append(from_vector3d(shd.normal))

def add_model(model, points, vectors):
    """Add Model normals."""
    for room in model.rooms:
        add_room(room, points, vectors)
    for face in model.orphaned_faces:
        add_face(face, points, vectors)
    for ap in model.orphaned_apertures:
        add_aperture(ap, points, vectors)
    for dr in model.orphaned_doors:
        add_door(door, points, vectors)
    for shd in model.orphaned_shades:
        points.append(from_point3d(shd.center))
        vectors.append(from_vector3d(shd.normal))


if all_required_inputs(ghenv.Component):
    # list of rhino geometry to be filled with content
    points = []
    vectors = []

    # loop through all objects and add them
    for hb_obj in _hb_objs:
        if isinstance(hb_obj, Room):
            add_room(hb_obj, points, vectors)
        elif isinstance(hb_obj, Face):
            add_face(hb_obj, points, vectors)
        elif isinstance(hb_obj, Aperture):
            add_aperture(hb_obj, points, vectors)
        elif isinstance(hb_obj, Door):
            add_door(hb_obj, points, vectors)
        elif isinstance(hb_obj, Shade):
            points.append(from_point3d(hb_obj.center))
            vectors.append(from_vector3d(hb_obj.normal))
        elif isinstance(hb_obj, Model):
            add_model(hb_obj, points, vectors)
        else:
            raise TypeError(
                'Unrecognized honeybee object type: {}'.format(type(hb_obj)))
# ---------- end normals ----------

vlen = VectorLength(Vector=wind_direction.R)
panel_6 = Panel(vlen)

# ----
# Scale and Display Vector
scalar = Slider(4, range=0..100)

vizairflow = VizAirflow(N=subtraction, nvector=normals.vectors, time=item_2, scalar=scalar)  # -> C, R

vdisex_2 = VectorDisplayEx(Point=normals.points, Vector=vizairflow.R, Colour=vizairflow.C, Width=3)

# ==== cluster WindDirection
epw_file = ClusterInput()
importepw = LBImportEPW(epw_file=epw_file)  # -> location, dry_bulb_temperature, dew_point_temperature, relative_humidity, wind_speed, wind_direction, direct_normal_rad, diffuse_horizontal_rad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; plug-in component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
hoy = ClusterInput()
xdata = LBDeconstructData(data=importepw.wind_speed)  # -> header, values; plug-in component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
xdata_2 = LBDeconstructData(data=importepw.wind_direction)  # -> header, values; plug-in component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
hoy_2 = Data(hoy)
north = ClusterInput()
item = ListItem(List=xdata.values, Index=hoy_2, Wrap=True)
item_2 = ListItem(List=xdata_2.values, Index=hoy_2, Wrap=True)
subtraction = Subtraction(Wind_dir=item_2, North=north)
bnd = Bounds(Numbers=flatten(xdata.values))
vec = VectorXYZ(XComponent=0, YComponent="-1", ZComponent=0)  # -> Vector, Length
vec_2 = VectorXYZ(XComponent=0, YComponent=0, ZComponent="-1")  # -> Vector, Length
units = LBUnitConverter(values=subtraction, from_u="degrees", to_u="radians")  # -> all_u, values; plug-in component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
dedomain = DeconstructDomain(Domain=bnd)  # -> Start, End
vrot = Rotate(Vector=vec.Vector, Axis=vec_2.Vector, Angle=units.values)
gradient = Gradient(
    LowerLimit=dedomain.Start,
    UpperLimit=dedomain.End,
    Parameter=item,
    stops=[0: RGB(0, 128, 0), 0.5: RGB(255, 174, 0), 1: RGB(255, 0, 0)])
multiplication = Multiplication(A=vrot, B=item)
B = ClusterInput()
multiplication_2 = Multiplication(A=multiplication, B=B)
C = ClusterOutput(gradient)
R = ClusterOutput(multiplication_2)

# ==== cluster VizAirflow
time = ClusterInput()
nvector = ClusterInput()
multiplication = Multiplication(NVector=nvector, B=time)
scalar = ClusterInput()
N = ClusterInput()
multiplication_2 = Multiplication(A=multiplication, Scalar=scalar)
bnd = Bounds(Numbers=flatten(N))
R = ClusterOutput(multiplication_2)
abs = Absolute(Value=time)
dedomain = DeconstructDomain(Domain=bnd)  # -> Start, End
gradient = Gradient(
    LowerLimit=0,
    UpperLimit=dedomain.End,
    Parameter=abs,
    stops=[0: RGB(0, 128, 0), 0.5: RGB(255, 174, 0), 1: RGB(255, 0, 0)])
C = ClusterOutput(gradient)
