# Grasshopper definition TrueFlow.gh (Grasshopper 1.0.7)

# ----
# Create Rooms
panel = Panel("2013::LargeOffice::OpenOffice")  # disabled
# Ref
panel_2 = Panel("2013::ClimateZone3::SteelFramed")  # disabled
panel_3 = Panel("2019::LargeOffice::Lobby")  # disabled
toggle = BooleanToggle(True)  # disabled
panel_4 = Panel("OPEN_OFFICE")  # disabled
panel_5 = Panel("LOBBY")  # disabled
office = Geometry([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])  # disabled
lobby = Geometry(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)  # disabled
roomsolid = HBRoomFromSolid(geo=flatten(office), name=panel_4, constr_set=panel_2, program=panel, conditioned=toggle)  # -> report, rooms; disabled; plug-in component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
roomsolid_2 = HBRoomFromSolid(geo=flatten(lobby), name=panel_5, constr_set=panel_2, program=panel_3, conditioned=toggle)  # -> report, rooms; disabled; plug-in component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

# ----
# North
north = Slider(0, range=-360..360)  # disabled

# ----
# Solve Adjacency
panel_6 = Panel("AirBoundary")  # disabled
air_boundary = Geometry([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])  # disabled
panel_7 = Panel("Adiabatic")  # disabled
adiabatic = Geometry([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])  # disabled
guidesurface = HBPropertiesByGuideSurface(rooms=[roomsolid.rooms, roomsolid_2.rooms], guide=adiabatic, bc=panel_7)  # -> rooms; disabled; plug-in component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
guidesurface_2 = HBPropertiesByGuideSurface(rooms=guidesurface, guide=air_boundary, type=panel_6)  # -> rooms; disabled; plug-in component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
toggle_2 = BooleanToggle(True)  # disabled
solveadj = HBSolveAdjacency(rooms=flatten(guidesurface_2), run=toggle_2)  # -> report, adj_rooms; disabled; plug-in component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

# ----
# Create Windows
panel_8 = Panel("0.4")  # disabled
facparam = HBFacadeParameters(north=panel_8, east=0, south=panel_8, west=0)  # -> fac_par; disabled; plug-in component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
toggle_3 = BooleanToggle(True)  # disabled
aperturesbyratio = HBAperturesByRatio(hb_objs=flatten(solveadj.adj_rooms), ratio=facparam, operable=toggle_3)  # -> report, hb_objs; disabled; plug-in component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

# ----
# Assing Window Ventilation
# Control Strategy
panel_9 = Panel("60")  # disabled
panel_10 = Panel("23")  # disabled
applysetpointvals = HBApplySetpointValues(room_or_program=flatten(aperturesbyratio.hb_objs), cooling_setpt=panel_9)  # -> report, mod_obj; disabled; plug-in component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
ventcontrol = HBVentilationControl(min_in_temp=panel_10)  # -> vent_cntrl; disabled; plug-in component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
windowopen = HBWindowOpening(rooms=flatten(applysetpointvals.mod_obj), vent_cntrl=ventcontrol)  # -> report, rooms; disabled; plug-in component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

# ----
# Visualize Model
vizbytype = HBVisualizeByType(hb_objs=aperturesbyratio.hb_objs)  # -> walls, interior_walls, roofs, ceilings, exterior_floors, interior_floors, air_walls, apertures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; disabled; plug-in component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

geo = Geometry([vizbytype.apertures, vizbytype.wire_frame, vizbytype.air_walls])  # disabled

# ----
# Download EPW File
panel_11 = Panel("https://energyplus-weather.s3.amazonaws.com/north_and_central_america_wmo_region_4/USA/MA/USA_MA_Boston-Logan.Intl.AP.725090_TMY3/USA_MA_Boston-Logan.Intl.AP.725090_TMY3.zip")  # disabled
downloadepw = LBDownloadWeather(weather_URL=panel_11)  # -> epw_file, stat_file, ddy_file; disabled; plug-in component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

# ----
# Setup the Model with the Airflow Network
panel_12 = Panel("AFN_Office")  # disabled
model = HBModel(rooms=flatten(windowopen.rooms), name=panel_12)  # -> report, model; disabled; plug-in component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
toggle_4 = BooleanToggle(True)  # disabled
afn = HBAirflowNewtwork(model=model.model, high_rise=toggle_4)  # -> report, model; disabled; plug-in component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

afn_flow = Text(["AFN Linkage Node 1 to Node 2 Volume Flow Rate", "AFN Linkage Node 2 to Node 1 Volume Flow Rate"])  # disabled

toggle_5 = BooleanToggle(True)
simoutput = HBSimulationOutput(gains_and_losses=toggle_5, comfort_metrics=toggle_5)  # -> report, sim_output; plug-in component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
afn_flow_2 = Text(["AFN Linkage Node 1 to Node 2 Volume Flow Rate", "AFN Linkage Node 2 to Node 1 Volume Flow Rate"])
customoutput = HBCustomSimulationOutput(base_sim_output=simoutput.sim_output, output_names=afn_flow_2)  # -> report, sim_output; plug-in component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
simpar = HBSimulationParameter(north="0", output=customoutput.sim_output, timestep=6)  # -> sim_par; plug-in component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

# ----
# EPW
panel_13 = Panel("C:\ladybug\epw\Tokyo_EA2010StandardYear.epw")

# ----
# Center
pt = Point(Point(16, 9, 0))  # disabled

# ----
# North
north_2 = Data(north)  # disabled

# ----
# Pick time
number_slider = Slider(8, range=1..12)  # disabled
number_slider_2 = Slider(14, range=0..23)  # disabled
number_slider_3 = Slider(30, range=1..31)  # disabled

toggle_6 = BooleanToggle(False)

# ----
# Create Rooms
pipeline = GeometryPipeline(
    GroupByLayer=False,
    GroupByType=False,
    IncludeHidden=True,
    IncludeLocked=True,
    LayerFilter="rooms",
    NameFilter="*",
    SublayerFiltering=True,
    TypeFilter=1073741848)

brep = Brep(pipeline)

intsolid = HBIntersectSolids(solids=flatten(brep), run=Toggle(True))  # -> int_solids; plug-in component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
roomsolid_3 = HBRoomFromSolid(geo=flatten(intsolid), conditioned=Toggle(True))  # -> report, rooms; plug-in component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

# ----
# Solve Adjacency
pipeline_2 = GeometryPipeline(
    GroupByLayer=False,
    GroupByType=False,
    IncludeHidden=True,
    IncludeLocked=True,
    LayerFilter="airwall-guide",
    NameFilter="*",
    SublayerFiltering=True,
    TypeFilter=1073741848)
brep_2 = Brep(pipeline_2)
guidesurface_3 = HBPropertiesByGuideSurface(rooms=roomsolid_3.rooms, guide=brep_2, type="AirBoundary")  # -> rooms; plug-in component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
solveadj_2 = HBSolveAdjacency(rooms=flatten(guidesurface_3), run=Toggle(True))  # -> report, adj_rooms; plug-in component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

# ----
# Create Windows
pipeline_3 = GeometryPipeline(
    GroupByLayer=False,
    GroupByType=False,
    IncludeHidden=True,
    IncludeLocked=True,
    LayerFilter="grazings",
    NameFilter="*",
    SublayerFiltering=True,
    TypeFilter=1073741848)

brep_3 = Brep(pipeline_3)

aperture = HBAperture(geo=brep_3, operable=Toggle(True))  # -> report, apertures; plug-in component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
addsubface = HBAddSubface(hb_obj=flatten(solveadj_2.adj_rooms), sub_faces=flatten(aperture.apertures))  # -> hb_obj; plug-in component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

panel_14 = Panel(aperture.apertures)
python = HBモデルチェック(data=aperture.apertures)  # -> names, normals; inputs data: list
# ---------- python: Python ----------
import rhinoscriptsyntax as rs
names = None
normals = None
names = []
normals = []

if data:
    for d in data:
        name = d.display_name
        names.append(name)
        normal = d.normal
        normals.append(normal)
# ---------- end python ----------
panel_15 = Panel(python.names)

# ----
# Assing Window Ventilation
# Control Strategy
panel_16 = Panel("60")
applysetpointvals_2 = HBApplySetpointValues(room_or_program=flatten(addsubface), cooling_setpt=panel_16)  # -> report, mod_obj; plug-in component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
ventcontrol_2 = HBVentilationControl(min_in_temp="23")  # -> vent_cntrl; plug-in component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
windowopen_2 = HBWindowOpening(rooms=flatten(applysetpointvals_2.mod_obj), vent_cntrl=ventcontrol_2)  # -> report, rooms; plug-in component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

# ----
# Setup the Model with the Airflow Network
panel_17 = Panel("TrueFlow-sample")
model_2 = HBModel(rooms=flatten(windowopen_2.rooms), name=panel_17)  # -> report, model; plug-in component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
afn_2 = HBAirflowNewtwork(model=model_2.model, high_rise=Toggle(True))  # -> report, model; plug-in component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

vizbytype_2 = HBVisualizeByType(hb_objs=afn_2.model)  # -> walls, interior_walls, roofs, ceilings, exterior_floors, interior_floors, air_walls, apertures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; plug-in component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
modeltoosm = HBModelToOSM(model=afn_2.model, epw_file=panel_13, sim_par=simpar, write=Toggle(False), run="2")  # -> report, jsons, osw, osm, idf, sql, zsz, rdd, html; plug-in component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
python_2 = GhPythonScript(osm=modeltoosm.osm, run=Toggle(False))  # -> out, osm; inputs run: Boolean
# ---------- python_2: Python ----------
from ladybug_rhino.grasshopper import all_required_inputs
from ladybug_rhino.openstudio import load_osm, dump_osm, import_openstudio

OpenStudio = import_openstudio()

if all_required_inputs(ghenv.Component) and _run:
    # load the Model from the OSM
    model = load_osm(_osm)

    # change the simulation control to use detailed pressur input
    afn_control = model.getAirflowNetworkSimulationControl()
    afn_control.setWindPressureCoefficientType('Input')
    afn_control.setHeightSelectionforLocalWindPressureCalculation('ExternalNode')

    # get all of the AirflowNetworkSurfaces and set their properties
    afn_surfaces = model.getAirflowNetworkSurfaces()
    for afn_srf in afn_surfaces:
        if afn_srf.surface() and afn_srf.surface().name():
            srf_name = afn_srf.surface().name().get()
            e_node = OpenStudio.AirflowNetworkExternalNode(model)
            e_node.setName('{}_afn_node'.format(srf_name))
            press_table = OpenStudio.CurveLinear(model)
            press_table.setMinimumValueofx(0)
            press_table.setMaximumValueofx(360)
            press_table.setCoefficient1Constant(0)
            e_node.setWindPressureCoefficientCurve(press_table)
            afn_srf.setExternalNode(e_node)

    # save the edited OSM over the original one
    osm = dump_osm(model, _osm)
# ---------- end python_2 ----------
runosm = HBRunOSM(osm=python_2.osm, epw_file=panel_13, translate=toggle_6, run=toggle_6)  # -> report, idf, sql, zsz, rdd, html; plug-in component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
panel_18 = Panel(runosm.idf)

# ----
# Request Outputs
toggle_7 = BooleanToggle(True)  # disabled
simoutput_2 = HBSimulationOutput(gains_and_losses=toggle_7, comfort_metrics=toggle_7)  # -> report, sim_output; disabled; plug-in component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
panel_19 = Panel("9")  # disabled
panel_20 = Panel("6")  # disabled
analysisperiod = LBAnalysisPeriod(start_month=panel_20, start_day=1, start_hour=0, end_month=panel_19)  # -> period, hoys, dates; disabled; plug-in component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

customoutput_2 = HBCustomSimulationOutput(base_sim_output=simoutput_2.sim_output, output_names=afn_flow)  # -> report, sim_output; disabled; plug-in component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

simpar_2 = HBSimulationParameter(north=north, output=customoutput_2.sim_output, run_period=analysisperiod.period, timestep=6)  # -> sim_par; disabled; plug-in component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

# ----
# Run
toggle_8 = BooleanToggle(True)  # disabled
modeltoosm_2 = HBModelToOSM(model=afn.model, epw_file=downloadepw.epw_file, sim_par=simpar_2, write=toggle_8, run=toggle_8)  # -> report, jsons, osw, osm, idf, sql, zsz, rdd, html; disabled; plug-in component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

# ----
# Net Airflow
bang = ExplodeTree(Data=graft(Tree({0;0}: ["AFN Linkage Node 1 to Node 2 Volume Flow Rate"], {0;1}: ["AFN Linkage Node 2 to Node 1 Volume Flow Rate"])))  # -> Branch0, Branch1; disabled
customresult = HBReadCustomResult(sql=modeltoosm_2.sql, output_names=bang.Branch0)  # -> results; disabled; plug-in component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
customresult_2 = HBReadCustomResult(sql=modeltoosm_2.sql, output_names=bang.Branch1)  # -> results; disabled; plug-in component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
xdata = LBDeconstructData(data=customresult_2)  # -> header, values; disabled; plug-in component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
xdata_2 = LBDeconstructData(data=customresult)  # -> header, values; disabled; plug-in component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
subtraction = Subtraction(A=xdata_2.values, B=xdata.values)  # disabled

# ----
# Filter surfaces
decnstrobj = HBDeconstructObject(hb_obj=windowopen.rooms)  # -> faces, apertures, doors, shades; disabled; plug-in component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
filter = GhPythonScript(faces=flatten([decnstrobj.faces, decnstrobj.apertures, decnstrobj.doors]), header=xdata_2.header)  # -> surfaces; inputs faces: list, header: list; disabled
# ---------- filter: Python ----------
"""Filters and sorts airflow surfaces based on the airflow data headers.
    Inputs:
        faces: Deconstructed faces from honeybee.
        airflow: The string of face identifiers from airflow network results.
    Output:
        surfaces: The sorted list of surfaces that contain airflow data"""

__author__ = "kenta"
__version__ = "2021.10.26"

# Read surface names from AFN header
AFN_header = [header[i].metadata['System'] for i in range(len(header))]

# Filter only surfaces with airflow results
surfaces = []
srf_ID = []
for face in faces:
    face_id = face.identifier.upper()
    if face_id in AFN_header:
        surfaces.append(face)
        srf_ID.append(face_id)

# Sort surfaces to match AFN results
index = []
for id in AFN_header:
    index.append(srf_ID.index(id))
surfaces = [surfaces[i] for i in index]
# ---------- end filter ----------

hoy = LBCalculateHOY(month=number_slider, day=number_slider_3, hour=number_slider_2)  # -> flatten(hoy), flatten(doy), flatten(date); disabled; plug-in component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
item = ListItem(List=analysisperiod.hoys, Index=0, Wrap=True)  # disabled
subtraction_2 = Subtraction(A=hoy.hoy, B=item)  # disabled
item_2 = ListItem(List=subtraction, Index=subtraction_2, Wrap=True)  # -> flatten(Item); disabled

# ----
# Wind Direction Display
scale = Slider(0.2, range=0..1)  # disabled
number_slider_4 = Slider(0.25, range=0..1)  # disabled
wind_direction = WindDirection(hoy=hoy.hoy, B=scale, north=north_2, epw_file=downloadepw.epw_file)  # -> R, C; disabled
compass = LBCompass(north=north_2, center=pt, scale=number_slider_4)  # -> compass; disabled; plug-in component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
vdisex = VectorDisplayEx(Point=pt, Vector=wind_direction.R, Colour=wind_direction.C, Width=5)  # disabled

# ----
# Normal Vector to Surface
normals = GhPythonScript(hb_objs=filter)  # -> points, vectors; inputs hb_objs: list; disabled
# ---------- normals: Python ----------
__author__ = "kenta"
__version__ = "2022.05.21"

# Rewrote Visual Normals to not include subsurfaces

try:  # import the core honeybee dependencies
    from honeybee.model import Model
    from honeybee.room import Room
    from honeybee.face import Face
    from honeybee.aperture import Aperture
    from honeybee.door import Door
    from honeybee.shade import Shade
except ImportError as e:
    raise ImportError('\nFailed to import honeybee:\n\t{}'.format(e))

try:  # import the ladybug_rhino dependencies
    from ladybug_rhino.fromgeometry import from_point3d, from_vector3d
    from ladybug_rhino.grasshopper import all_required_inputs
except ImportError as e:
    raise ImportError('\nFailed to import ladybug_rhino:\n\t{}'.format(e))


def add_door(door, points, vectors):
    """Add Door normals."""
    points.append(from_point3d(door.center))
    vectors.append(from_vector3d(door.normal))
    for shd in door.shades:
        points.append(from_point3d(shd.center))
        vectors.append(from_vector3d(shd.normal))

def add_aperture(aperture, points, vectors):
    """Add Aperture normals."""
    points.append(from_point3d(aperture.center))
    vectors.append(from_vector3d(aperture.normal))
    for shd in aperture.shades:
        points.append(from_point3d(shd.center))
        vectors.append(from_vector3d(shd.normal))

def add_face(face, points, vectors):
    """Add Face normals.
    Modified to only include face normals and not aperatures or doors"""
    points.append(from_point3d(face.center))
    vectors.append(from_vector3d(face.normal))

def add_room(room, points, vectors):
    """Add Room normals."""
    for face in room.faces:
        add_face(face, points, vectors)
    for shd in room.shades:
        points.append(from_point3d(shd.center))
        vectors.append(from_vector3d(shd.normal))

def add_model(model, points, vectors):
    """Add Model normals."""
    for room in model.rooms:
        add_room(room, points, vectors)
    for face in model.orphaned_faces:
        add_face(face, points, vectors)
    for ap in model.orphaned_apertures:
        add_aperture(ap, points, vectors)
    for dr in model.orphaned_doors:
        add_door(door, points, vectors)
    for shd in model.orphaned_shades:
        points.append(from_point3d(shd.center))
        vectors.append(from_vector3d(shd.normal))


if all_required_inputs(ghenv.Component):
    # list of rhino geometry to be filled with content
    points = []
    vectors = []

    # loop through all objects and add them
    for hb_obj in _hb_objs:
        if isinstance(hb_obj, Room):
            add_room(hb_obj, points, vectors)
        elif isinstance(hb_obj, Face):
            add_face(hb_obj, points, vectors)
        elif isinstance(hb_obj, Aperture):
            add_aperture(hb_obj, points, vectors)
        elif isinstance(hb_obj, Door):
            add_door(hb_obj, points, vectors)
        elif isinstance(hb_obj, Shade):
            points.append(from_point3d(hb_obj.center))
            vectors.append(from_vector3d(hb_obj.normal))
        elif isinstance(hb_obj, Model):
            add_model(hb_obj, points, vectors)
        else:
            raise TypeError(
                'Unrecognized honeybee object type: {}'.format(type(hb_obj)))
# ---------- end normals ----------

# ----
# Scale and Display Vector
scalar = Slider(1, range=0..20)  # disabled

vizairflow = VizAirflow(N=subtraction, nvector=normals.vectors, time=item_2, scalar=scalar)  # -> C, R; disabled

vdisex_2 = VectorDisplayEx(Point=normals.points, Vector=vizairflow.R, Colour=vizairflow.C, Width=3)  # disabled

# ==== cluster WindDirection
epw_file = ClusterInput()
importepw = LBImportEPW(epw_file=epw_file)  # -> location, dry_bulb_temperature, dew_point_temperature, relative_humidity, wind_speed, wind_direction, direct_normal_rad, diffuse_horizontal_rad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; plug-in component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
hoy = ClusterInput()
xdata = LBDeconstructData(data=importepw.wind_speed)  # -> header, values; plug-in component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
xdata_2 = LBDeconstructData(data=importepw.wind_direction)  # -> header, values; plug-in component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
hoy_2 = Data(hoy)
north = ClusterInput()
item = ListItem(List=xdata.values, Index=hoy_2, Wrap=True)
item_2 = ListItem(List=xdata_2.values, Index=hoy_2, Wrap=True)
subtraction = Subtraction(Wind_dir=item_2, North=north)
bnd = Bounds(Numbers=flatten(xdata.values))
vec = VectorXYZ(XComponent=0, YComponent="-1", ZComponent=0)  # -> Vector, Length
vec_2 = VectorXYZ(XComponent=0, YComponent=0, ZComponent="-1")  # -> Vector, Length
units = LBUnitConverter(values=subtraction, from_u="degrees", to_u="radians")  # -> all_u, values; plug-in component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
dedomain = DeconstructDomain(Domain=bnd)  # -> Start, End
vrot = Rotate(Vector=vec.Vector, Axis=vec_2.Vector, Angle=units.values)
gradient = Gradient(
    LowerLimit=dedomain.Start,
    UpperLimit=dedomain.End,
    Parameter=item,
    stops=[0: RGB(0, 128, 0), 0.5: RGB(255, 174, 0), 1: RGB(255, 0, 0)])
multiplication = Multiplication(A=vrot, B=item)
B = ClusterInput()
multiplication_2 = Multiplication(A=multiplication, B=B)
C = ClusterOutput(gradient)
R = ClusterOutput(multiplication_2)

# ==== cluster VizAirflow
time = ClusterInput()
nvector = ClusterInput()
multiplication = Multiplication(NVector=nvector, B=time)
scalar = ClusterInput()
N = ClusterInput()
multiplication_2 = Multiplication(A=multiplication, Scalar=scalar)
bnd = Bounds(Numbers=flatten(N))
R = ClusterOutput(multiplication_2)
abs = Absolute(Value=time)
dedomain = DeconstructDomain(Domain=bnd)  # -> Start, End
gradient = Gradient(
    LowerLimit=0,
    UpperLimit=dedomain.End,
    Parameter=abs,
    stops=[0: RGB(0, 128, 0), 0.5: RGB(255, 174, 0), 1: RGB(255, 0, 0)])
C = ClusterOutput(gradient)
