# Grasshopper definition TrueFlow_modelrevise.gh (Grasshopper 1.0.7)

# ----
# Create a Building by Dragonfly
panel = Panel("12.5")
rectangle = Rectangle(Plane=PlaneXY(0, 0, 0), XSize=panel, YSize=panel, Radius=0)  # -> Rectangle, Length
Z = UnitZ(Factor=Slider(30, range=15..45))
extr = Extrude(Base=rectangle.Rectangle, Direction=Z)
cap = CapHoles(Brep=extr)
buildingsolid = DFBuildingFromSolid(bldg_geo=flatten(cap), floor_to_floor="@3", perim_offset="3", run=Toggle(True))  # -> report, buildings; plug-in component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
model = DFModel(buildings=flatten(buildingsolid.buildings))  # -> report, model; plug-in component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

# ----
# To HB model
toggle = BooleanToggle(False)
tohoneybee = DFModelToHoneybee(model=model.model, use_multiplier=toggle, run=Toggle(True))  # -> report, hb_models; plug-in component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

# ----
# Add Glazings
deconstructmodel = HBDeconstructModel(model=tohoneybee.hb_models)  # -> rooms, faces, apertures, doors, shades; plug-in component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
aperturesbyratio = HBAperturesByRatio(
    hb_objs=flatten(deconstructmodel.rooms),
    ratio=Slider(0.4, range=0.1..0.9),
    subdivide=Toggle(True),
    win_height="2.5",
    sill_height="0.2",
    operable=Toggle(True))  # -> report, hb_objs; plug-in component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

decnstrobj = HBDeconstructObject(hb_obj=aperturesbyratio.hb_objs)  # -> faces, apertures, doors, shades; plug-in component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
python = HBモデルチェック(data=decnstrobj.apertures)  # -> names, normals; inputs data: list
# ---------- python: Python ----------
import rhinoscriptsyntax as rs
names = None
normals = None
names = []
normals = []

if data:
    for d in data:
        name = d.display_name
        names.append(name)
        normal = d.normal
        normals.append(normal)
# ---------- end python ----------

# ----
# Add AirBoundary
vizbytype = HBVisualizeByType(hb_objs=aperturesbyratio.hb_objs)  # -> walls, interior_walls, roofs, ceilings, exterior_floors, interior_floors, air_walls, apertures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; plug-in component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
geo = Geometry(vizbytype.interior_walls)
guidesurface = HBPropertiesByGuideSurface(rooms=aperturesbyratio.hb_objs, guide=geo, type="AirBoundary")  # -> rooms; plug-in component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

panel_2 = Panel(python.names)
vizbytype_2 = HBVisualizeByType(hb_objs=guidesurface)  # -> walls, interior_walls, roofs, ceilings, exterior_floors, interior_floors, air_walls, apertures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; plug-in component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

# ----
# Assing Window Ventilation
# Control Strategy
panel_3 = Panel("60")
applysetpointvals = HBApplySetpointValues(room_or_program=flatten(aperturesbyratio.hb_objs), cooling_setpt=panel_3)  # -> report, mod_obj; plug-in component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
ventcontrol = HBVentilationControl(min_in_temp="23")  # -> vent_cntrl; plug-in component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
windowopen = HBWindowOpening(rooms=flatten(applysetpointvals.mod_obj), vent_cntrl=ventcontrol)  # -> report, rooms; plug-in component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

# ----
# Setup the Model with the Airflow Network
panel_4 = Panel("TrueFlow-sample")
model_2 = HBModel(rooms=flatten(windowopen.rooms), name=panel_4)  # -> report, model; plug-in component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
afn = HBAirflowNewtwork(model=model_2.model, high_rise=Toggle(True))  # -> report, model; plug-in component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

toggle_2 = BooleanToggle(True)
simoutput = HBSimulationOutput(gains_and_losses=toggle_2, comfort_metrics=toggle_2)  # -> report, sim_output; plug-in component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
afn_flow = Text(["AFN Linkage Node 1 to Node 2 Volume Flow Rate", "AFN Linkage Node 2 to Node 1 Volume Flow Rate"])
customoutput = HBCustomSimulationOutput(base_sim_output=simoutput.sim_output, output_names=afn_flow)  # -> report, sim_output; plug-in component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
simpar = HBSimulationParameter(north="0", output=customoutput.sim_output, timestep=6)  # -> sim_par; plug-in component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

vizbytype_3 = HBVisualizeByType(hb_objs=afn.model)  # -> walls, interior_walls, roofs, ceilings, exterior_floors, interior_floors, air_walls, apertures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; plug-in component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
# EPW
panel_5 = Panel("C:\ladybug\epw\Tokyo_EA2010StandardYear.epw")
modeltoosm = HBModelToOSM(model=afn.model, epw_file=panel_5, sim_par=simpar, write=Toggle(False), run="2")  # -> report, jsons, osw, osm, idf, sql, zsz, rdd, html; plug-in component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

# ----
# OLD
panel_6 = Panel("")

python_2 = GhPythonScript(osm=modeltoosm.osm, run=Toggle(False))  # -> out, osm; inputs run: Boolean
# ---------- python_2: Python ----------
from ladybug_rhino.grasshopper import all_required_inputs
from ladybug_rhino.openstudio import load_osm, dump_osm, import_openstudio

OpenStudio = import_openstudio()

if all_required_inputs(ghenv.Component) and _run:
    # load the Model from the OSM
    model = load_osm(_osm)

    # change the simulation control to use detailed pressur input
    afn_control = model.getAirflowNetworkSimulationControl()
    afn_control.setWindPressureCoefficientType('Input')
    afn_control.setHeightSelectionforLocalWindPressureCalculation('ExternalNode')

    # get all of the AirflowNetworkSurfaces and set their properties
    afn_surfaces = model.getAirflowNetworkSurfaces()
    for afn_srf in afn_surfaces:
        if afn_srf.surface() and afn_srf.surface().name():
            srf_name = afn_srf.surface().name().get()
            e_node = OpenStudio.AirflowNetworkExternalNode(model)
            e_node.setName('{}_afn_node'.format(srf_name))
            press_table = OpenStudio.CurveLinear(model)
            press_table.setMinimumValueofx(0)
            press_table.setMaximumValueofx(360)
            press_table.setCoefficient1Constant(0)
            e_node.setWindPressureCoefficientCurve(press_table)
            afn_srf.setExternalNode(e_node)

    # save the edited OSM over the original one
    osm = dump_osm(model, _osm)
# ---------- end python_2 ----------
toggle_3 = BooleanToggle(False)
runosm = HBRunOSM(osm=python_2.osm, epw_file=panel_5, translate=toggle_3, run=toggle_3)  # -> report, idf, sql, zsz, rdd, html; plug-in component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
panel_8 = Panel(runosm.idf)
