# Grasshopper definition TrueFlow_v3.gh (Grasshopper 1.0.7)

# ----
# Create a Building by Dragonfly
panel = Panel("12.5")
number_slider = Slider(30, range=15..45)
rectangle = Rectangle(Plane=PlaneXY(0, 0, 0), XSize=panel, YSize=panel, Radius=0)  # -> Rectangle, Length
Z = UnitZ(Factor=number_slider)
extr = Extrude(Base=rectangle.Rectangle, Direction=Z)
cap = CapHoles(Brep=extr)
buildingsolid = DFBuildingFromSolid(bldg_geo=flatten(cap), floor_to_floor="@3", perim_offset="3", run=Toggle(True))  # -> report, buildings; plug-in component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
model = DFModel(buildings=flatten(buildingsolid.buildings))  # -> report, model; plug-in component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

# ----
# Create Rooms
panel_2 = Panel("2013::LargeOffice::OpenOffice")  # disabled
# Ref
panel_3 = Panel("2013::ClimateZone3::SteelFramed")  # disabled
panel_4 = Panel("2019::LargeOffice::Lobby")  # disabled
toggle = BooleanToggle(True)  # disabled
panel_5 = Panel("OPEN_OFFICE")  # disabled
panel_6 = Panel("LOBBY")  # disabled
office = Geometry([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])  # disabled
lobby = Geometry(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)  # disabled
roomsolid = HBRoomFromSolid(geo=flatten(office), name=panel_5, constr_set=panel_3, program=panel_2, conditioned=toggle)  # -> report, rooms; disabled; plug-in component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
roomsolid_2 = HBRoomFromSolid(geo=flatten(lobby), name=panel_6, constr_set=panel_3, program=panel_4, conditioned=toggle)  # -> report, rooms; disabled; plug-in component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

Z_2 = Data(number_slider)
X = Data(panel)
Y = Data(panel)

# ----
# North
north = Slider(0, range=-360..360)  # disabled

# ----
# Solve Adjacency
panel_7 = Panel("AirBoundary")  # disabled
air_boundary = Geometry([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])  # disabled
panel_8 = Panel("Adiabatic")  # disabled
adiabatic = Geometry([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])  # disabled
guidesurface = HBPropertiesByGuideSurface(rooms=[roomsolid.rooms, roomsolid_2.rooms], guide=adiabatic, bc=panel_8)  # -> rooms; disabled; plug-in component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
guidesurface_2 = HBPropertiesByGuideSurface(rooms=guidesurface, guide=air_boundary, type=panel_7)  # -> rooms; disabled; plug-in component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
toggle_2 = BooleanToggle(True)  # disabled
solveadj = HBSolveAdjacency(rooms=flatten(guidesurface_2), run=toggle_2)  # -> report, adj_rooms; disabled; plug-in component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

# ----
# To HB model
toggle_3 = BooleanToggle(False)
tohoneybee = DFModelToHoneybee(model=model.model, use_multiplier=toggle_3, run=Toggle(True))  # -> report, hb_models; plug-in component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

# ----
# Add Glazings
deconstructmodel = HBDeconstructModel(model=tohoneybee.hb_models)  # -> rooms, faces, apertures, doors, shades; plug-in component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
aperturesbyratio = HBAperturesByRatio(
    hb_objs=flatten(deconstructmodel.rooms),
    ratio=Slider(0.4, range=0.1..0.9),
    subdivide=Toggle(True),
    win_height="2.5",
    sill_height="0.2",
    operable=Toggle(True))  # -> report, hb_objs; plug-in component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

decnstrobj = HBDeconstructObject(hb_obj=aperturesbyratio.hb_objs)  # -> faces, apertures, doors, shades; plug-in component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

# ----
# Create Windows
panel_9 = Panel("0.4")  # disabled
facparam = HBFacadeParameters(north=panel_9, east=0, south=panel_9, west=0)  # -> fac_par; disabled; plug-in component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
toggle_4 = BooleanToggle(True)  # disabled
aperturesbyratio_2 = HBAperturesByRatio(hb_objs=flatten(solveadj.adj_rooms), ratio=facparam, operable=toggle_4)  # -> report, hb_objs; disabled; plug-in component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

python = HBモデルチェック(data=decnstrobj.apertures)  # -> names, normals; inputs data: list
# ---------- python: Python ----------
import rhinoscriptsyntax as rs
names = None
normals = None
names = []
normals = []

if data:
    for d in data:
        name = d.display_name
        names.append(name)
        normal = d.normal
        normals.append(normal)
# ---------- end python ----------

# ----
# Add AirBoundary
vizbytype = HBVisualizeByType(hb_objs=aperturesbyratio.hb_objs)  # -> walls, interior_walls, roofs, ceilings, exterior_floors, interior_floors, air_walls, apertures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; plug-in component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
geo = Geometry(vizbytype.interior_walls)
guidesurface_3 = HBPropertiesByGuideSurface(rooms=aperturesbyratio.hb_objs, guide=geo, type="AirBoundary")  # -> rooms; plug-in component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

panel_10 = Panel(python.names)

# ----
# Assing Window Ventilation
# Control Strategy
panel_11 = Panel("60")  # disabled
panel_12 = Panel("23")  # disabled
applysetpointvals = HBApplySetpointValues(room_or_program=flatten(aperturesbyratio_2.hb_objs), cooling_setpt=panel_11)  # -> report, mod_obj; disabled; plug-in component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
ventcontrol = HBVentilationControl(min_in_temp=panel_12)  # -> vent_cntrl; disabled; plug-in component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
windowopen = HBWindowOpening(rooms=flatten(applysetpointvals.mod_obj), vent_cntrl=ventcontrol)  # -> report, rooms; disabled; plug-in component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

vizbytype_2 = HBVisualizeByType(hb_objs=guidesurface_3)  # -> walls, interior_walls, roofs, ceilings, exterior_floors, interior_floors, air_walls, apertures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; plug-in component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

# ----
# Visualize Model
vizbytype_3 = HBVisualizeByType(hb_objs=aperturesbyratio_2.hb_objs)  # -> walls, interior_walls, roofs, ceilings, exterior_floors, interior_floors, air_walls, apertures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; disabled; plug-in component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

geo_2 = Geometry([vizbytype_3.apertures, vizbytype_3.wire_frame, vizbytype_3.air_walls])  # disabled

# ----
# Assing Window Ventilation
# Control Strategy
panel_13 = Panel("60")
applysetpointvals_2 = HBApplySetpointValues(room_or_program=flatten(aperturesbyratio.hb_objs), cooling_setpt=panel_13)  # -> report, mod_obj; plug-in component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
ventcontrol_2 = HBVentilationControl(min_in_temp="23")  # -> vent_cntrl; plug-in component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
windowopen_2 = HBWindowOpening(rooms=flatten(applysetpointvals_2.mod_obj), vent_cntrl=ventcontrol_2)  # -> report, rooms; plug-in component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

# ----
# Download EPW File
panel_14 = Panel("https://energyplus-weather.s3.amazonaws.com/north_and_central_america_wmo_region_4/USA/MA/USA_MA_Boston-Logan.Intl.AP.725090_TMY3/USA_MA_Boston-Logan.Intl.AP.725090_TMY3.zip")  # disabled
downloadepw = LBDownloadWeather(weather_URL=panel_14)  # -> epw_file, stat_file, ddy_file; disabled; plug-in component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

# ----
# Setup the Model with the Airflow Network
panel_15 = Panel("AFN_Office")  # disabled
model_2 = HBModel(rooms=flatten(windowopen.rooms), name=panel_15)  # -> report, model; disabled; plug-in component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
toggle_5 = BooleanToggle(True)  # disabled
afn = HBAirflowNewtwork(model=model_2.model, high_rise=toggle_5)  # -> report, model; disabled; plug-in component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

afn_flow = Text(["AFN Linkage Node 1 to Node 2 Volume Flow Rate", "AFN Linkage Node 2 to Node 1 Volume Flow Rate"])  # disabled

# ----
# Setup the Model with the Airflow Network
panel_16 = Panel("TrueFlow-sample")
model_3 = HBModel(rooms=flatten(windowopen_2.rooms), name=panel_16)  # -> report, model; plug-in component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
afn_2 = HBAirflowNewtwork(model=model_3.model, high_rise=Toggle(True))  # -> report, model; plug-in component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

vizquick = HBVisualizeQuick(hb_objs=flatten(afn_2.model))  # -> geo; plug-in component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
vizbytype_4 = HBVisualizeByType(hb_objs=afn_2.model)  # -> walls, interior_walls, roofs, ceilings, exterior_floors, interior_floors, air_walls, apertures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; plug-in component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
bbox = BoundingBox(Content=vizquick, Plane=PlaneXY(0, 0, 0), UnionBox=True)  # -> Box, Box_2

X_2 = Data(X)
Y_2 = Data(Y)
Z_3 = Data(Z_2)

# ----
# Setup the grid
panel_17 = Panel("0,0,0")
box = Box2Pt(PointA=panel_17, PointB="1,1,1", Plane=PlaneXY(0, 0, 0))
bbox_2 = BoundingBox(Content=box, Plane=PlaneXY(0, 0, 0), UnionBox=True)  # -> Box, Box_2
debrep = DeconstructBrep(Brep=bbox_2.Box_2)  # -> Faces, Edges, Vertices
item = ListItem(List=debrep.Faces, Index=0, Wrap=True)  # -> Item, Item1, Item2, Item3
number_slider_2 = Slider(4, range=0..10)
merge = Merge(Data1=item.Item, Data2=item.Item1, Data3=item.Item2, Data4=item.Item3)
sdivide = DivideSurface(Surface=merge, UCount=number_slider_2, VCount=number_slider_2)  # -> Points, Normals, Parameters
genpts = LBGeneratePointGrid(geometry=merge, grid_size="0.333")  # -> points, vectors, face_areas, mesh; plug-in component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
panel_18 = Panel("""0
3
6
1
4
7
2
5
8""")
scale_nu = ScaleNU(Geometry=genpts.mesh, Plane=PlaneXY(0, 0, 0), ScaleX=X_2, ScaleY=Y_2, ScaleZ=Z_3)  # -> Geometry, Transform
scale_nu_2 = ScaleNU(Geometry=genpts.points, Plane=PlaneXY(0, 0, 0), ScaleX=X_2, ScaleY=Y_2, ScaleZ=Z_3)  # -> Geometry, Transform
heatmap = LBSpatialHeatmap(values=panel_18, mesh=scale_nu.Geometry)  # -> mesh, legend, title, colors, legend_par; plug-in component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
sort = SortList(Keys=panel_18, ValuesA=scale_nu_2.Geometry)  # -> Keys, ValuesA
sort_2 = SortList(Keys=panel_18, ValuesA=genpts.vectors)  # -> Keys, ValuesA
panel_19 = Panel(sort_2.ValuesA)

aperture_properties = ApertureProperties(model=afn_2.model, grid_pts=flatten(sort.ValuesA), grid_vecs=flatten(sort_2.ValuesA))  # -> out, d, model, aperture_identifier, aperture_loc, aperture_dir, aperture_normal, aperture_center; inputs grid_pts: list of Point3d, grid_vecs: list of Vector3d
# ---------- aperture_properties: Python ----------
__author__ = "takahashi-yosh"

docs = "Aperture Properties"
ghenv.Component.Name = docs
ghenv.Component.NickName = docs
ghenv.Component.Message = docs
ghenv.Component.Category = docs

import rhinoscriptsyntax as rs

# written by Giulio Piacentino, giulio@mcneel.com
def tree_to_list(input, retrieve_base = lambda x: x[0]):
    """Returns a list representation of a Grasshopper DataTree
    https://gist.github.com/piac/ef91ac83cb5ee92a1294"""
    def extend_at(path, index, simple_input, rest_list):
        target = path[index]
        if len(rest_list) <= target: rest_list.extend([None]*(target-len(rest_list)+1))
        if index == path.Length - 1:
            rest_list[target] = list(simple_input)
        else:
            if rest_list[target] is None: rest_list[target] = []
            extend_at(path, index+1, simple_input, rest_list[target])
    all = []
    for i in range(input.BranchCount):
        path = input.Path(i)
        extend_at(path, 0, input.Branch(path), all)
    return retrieve_base(all)

aperture_normal = []
aperture_dir = []
aperture_loc = []
aperture_center = []
aperture_identifier = []
points = []
__d = dir(model)

grid_pts_set = {}
for pt, vec in zip(grid_pts, grid_vecs):
    __d = dir(vec)
    key = (vec.X, vec.Y, vec.Z)
    if key in grid_pts_set:
        grid_pts_set[key].append(pt)
    else:
        grid_pts_set[key] = [pt]

for room in model.rooms:
    for face in room.faces:
        for iaperture, aperture in enumerate(face.apertures):
            face_divided_pts = None
            for i, (key, value) in enumerate(grid_pts_set.items()):
                ang = rs.VectorAngle(key, aperture.normal)
                if ang < 1:
                    face_divided_pts = value
                    continue
                    

            
            min_dist = 9999999
            loc = 0
            for iloc, fpt in enumerate(face_divided_pts):
                dist = rs.Distance(aperture.center, fpt)
                if dist < min_dist:
                    min_dist = dist
                    
                    loc = iloc
            
            print(aperture.center, (fpt.X, fpt.Y, fpt.Z))
            print(loc)
            print(min_dist)
            
            angle = rs.VectorAngle((0, 1, 0), aperture.normal)
            if aperture.normal[0] <= 0:
                angle *= -1
                angle += 360
            aperture_normal.append(rs.CreateVector(aperture.normal.x, aperture.normal.y, aperture.normal.z))
            aperture_dir.append(angle)
            aperture_loc.append(loc)
            aperture_center.append(rs.CreatePoint(aperture.center.x, aperture.center.y, aperture.center.z))
            
            aperture.display_name = 'dir:{:03.0f}_loc:{}'.format(angle, loc)
            
            aperture.identifier = '{}_{}_Aperture_{}'.format(
                room.display_name, face.cardinal_direction(), iaperture)
            aperture_identifier.append(aperture.identifier)
# ---------- end aperture_properties ----------

# ----
# Visualize the assigned number by apertures
faceattr = HBFaceAttributes({"Display Name": "display_name", "Simulation Name (Identifier)": "identifier", "Boundary Condition": "boundary_condition", "Has Parent": "has_parent", "Parent": "parent", "Area": "area", "Perimeter": "perimeter", "Face Type": "type", "Aperture Is Operable": "is_operable", "Door Is Glass": "is_glass"}, selected="Display Name")
lablefaces = HBLabelFaces(hb_objs=flatten(aperture_properties.model), attribute=faceattr, sub_faces=Toggle(True))  # -> label_text, base_pts, labels, wire_frame; plug-in component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

# ----
# Center
pt = Point(Point(16, 9, 0))  # disabled

# ----
# North
north_2 = Data(north)  # disabled

# ----
# Pick time
number_slider_3 = Slider(8, range=1..12)  # disabled
number_slider_4 = Slider(14, range=0..23)  # disabled
number_slider_5 = Slider(30, range=1..31)  # disabled

toggle_6 = BooleanToggle(True)
simoutput = HBSimulationOutput(gains_and_losses=toggle_6, comfort_metrics=toggle_6)  # -> report, sim_output; plug-in component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
afn_flow_2 = Text(["AFN Linkage Node 1 to Node 2 Volume Flow Rate", "AFN Linkage Node 2 to Node 1 Volume Flow Rate"])
customoutput = HBCustomSimulationOutput(base_sim_output=simoutput.sim_output, output_names=afn_flow_2)  # -> report, sim_output; plug-in component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
simpar = HBSimulationParameter(north="0", output=customoutput.sim_output, timestep=6)  # -> sim_par; plug-in component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

# ----
# EPW
panel_20 = Panel("C:\Users\takahashi-yosh\Desktop\Tokyo_EA2010StandardYear.epw")
panel_21 = Panel(aperture_properties.aperture_identifier)
modeltoosm = HBModelToOSM(model=aperture_properties.model, epw_file=panel_20, sim_par=simpar, write=Toggle(False), run="2")  # -> report, jsons, osw, osm, idf, sql, zsz, rdd, html; plug-in component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
faceattr_2 = HBFaceAttributes({"Display Name": "display_name", "Simulation Name (Identifier)": "identifier", "Boundary Condition": "boundary_condition", "Has Parent": "has_parent", "Parent": "parent", "Area": "area", "Perimeter": "perimeter", "Face Type": "type", "Aperture Is Operable": "is_operable", "Door Is Glass": "is_glass"}, selected="Display Name")
data = Data()
lablefaces_2 = HBLabelFaces(hb_objs=flatten(data), attribute=faceattr_2, sub_faces=Toggle(True))  # -> label_text, base_pts, labels, wire_frame; plug-in component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
python_2 = GhPythonScript(osm=modeltoosm.osm, run=Toggle(True), aperture_identifier=panel_21)  # -> out, osm; inputs run: Boolean, aperture_identifier: list, wind_press_coeffs: list
# ---------- python_2: Python ----------
from ladybug_rhino.grasshopper import all_required_inputs
from ladybug_rhino.openstudio import load_osm, dump_osm, import_openstudio

OpenStudio = import_openstudio()

def get_osm_data(param):
    if param.is_initialized():
        return param.get()
    else:
        return False
        
if all_required_inputs(ghenv.Component) and _run:
    # load the Model from the OSM
    model = load_osm(_osm)

    # change the simulation control to use detailed pressur input
    afn_control = model.getAirflowNetworkSimulationControl()
    afn_control.setWindPressureCoefficientType('Input')
    afn_control.setHeightSelectionforLocalWindPressureCalculation('ExternalNode')
    
    
    for apid, wpcs in zip(aperture_identifier, wind_press_coeffs):
        srf = get_osm_data(model.getSubSurfaceByName(apid))
        if not srf:
            print('"{}" is not found'.format(apid))
            continue
        e_node = OpenStudio.AirflowNetworkExternalNode(model)
        e_node.setName('{}_afn_node'.format(apid))
        press_table = OpenStudio.TableMultiVariableLookup(model,1)
        for wpc, ang in zip(wpcs, range(0,360,45)):
            wpc = [i/10 for i in range(8)]
            press_table.addPoint(ang, wpc)
        e_node.setWindPressureCoefficientCurve(press_table)
        afn_srf.setExternalNode(e_node)
        
        

    # save the edited OSM over the original one
    osm = dump_osm(model, _osm)
# ---------- end python_2 ----------
toggle_7 = BooleanToggle(False)
runosm = HBRunOSM(osm=python_2.osm, epw_file=panel_20, translate=toggle_7, run=toggle_7)  # -> report, idf, sql, zsz, rdd, html; plug-in component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
panel_22 = Panel(runosm.idf)

# ----
# Request Outputs
toggle_8 = BooleanToggle(True)  # disabled
simoutput_2 = HBSimulationOutput(gains_and_losses=toggle_8, comfort_metrics=toggle_8)  # -> report, sim_output; disabled; plug-in component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
panel_23 = Panel("9")  # disabled
panel_24 = Panel("6")  # disabled
analysisperiod = LBAnalysisPeriod(start_month=panel_24, start_day=1, start_hour=0, end_month=panel_23)  # -> period, hoys, dates; disabled; plug-in component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

customoutput_2 = HBCustomSimulationOutput(base_sim_output=simoutput_2.sim_output, output_names=afn_flow)  # -> report, sim_output; disabled; plug-in component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

simpar_2 = HBSimulationParameter(north=north, output=customoutput_2.sim_output, run_period=analysisperiod.period, timestep=6)  # -> sim_par; disabled; plug-in component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

# ----
# Run
toggle_9 = BooleanToggle(True)  # disabled
modeltoosm_2 = HBModelToOSM(model=afn.model, epw_file=downloadepw.epw_file, sim_par=simpar_2, write=toggle_9, run=toggle_9)  # -> report, jsons, osw, osm, idf, sql, zsz, rdd, html; disabled; plug-in component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

# ----
# Net Airflow
bang = ExplodeTree(Data=graft(Tree({0;0}: ["AFN Linkage Node 1 to Node 2 Volume Flow Rate"], {0;1}: ["AFN Linkage Node 2 to Node 1 Volume Flow Rate"])))  # -> Branch0, Branch1; disabled
customresult = HBReadCustomResult(sql=modeltoosm_2.sql, output_names=bang.Branch0)  # -> results; disabled; plug-in component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
customresult_2 = HBReadCustomResult(sql=modeltoosm_2.sql, output_names=bang.Branch1)  # -> results; disabled; plug-in component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
xdata = LBDeconstructData(data=customresult_2)  # -> header, values; disabled; plug-in component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
xdata_2 = LBDeconstructData(data=customresult)  # -> header, values; disabled; plug-in component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
subtraction = Subtraction(A=xdata_2.values, B=xdata.values)  # disabled

# ----
# Filter surfaces
decnstrobj_2 = HBDeconstructObject(hb_obj=windowopen.rooms)  # -> faces, apertures, doors, shades; disabled; plug-in component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
filter = GhPythonScript(faces=flatten([decnstrobj_2.faces, decnstrobj_2.apertures, decnstrobj_2.doors]), header=xdata_2.header)  # -> surfaces; inputs faces: list, header: list; disabled
# ---------- filter: Python ----------
"""Filters and sorts airflow surfaces based on the airflow data headers.
    Inputs:
        faces: Deconstructed faces from honeybee.
        airflow: The string of face identifiers from airflow network results.
    Output:
        surfaces: The sorted list of surfaces that contain airflow data"""

__author__ = "kenta"
__version__ = "2021.10.26"

# Read surface names from AFN header
AFN_header = [header[i].metadata['System'] for i in range(len(header))]

# Filter only surfaces with airflow results
surfaces = []
srf_ID = []
for face in faces:
    face_id = face.identifier.upper()
    if face_id in AFN_header:
        surfaces.append(face)
        srf_ID.append(face_id)

# Sort surfaces to match AFN results
index = []
for id in AFN_header:
    index.append(srf_ID.index(id))
surfaces = [surfaces[i] for i in index]
# ---------- end filter ----------

hoy = LBCalculateHOY(month=number_slider_3, day=number_slider_5, hour=number_slider_4)  # -> flatten(hoy), flatten(doy), flatten(date); disabled; plug-in component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
item_2 = ListItem(List=analysisperiod.hoys, Index=0, Wrap=True)  # disabled
subtraction_2 = Subtraction(A=hoy.hoy, B=item_2)  # disabled
item_3 = ListItem(List=subtraction, Index=subtraction_2, Wrap=True)  # -> flatten(Item); disabled

# ----
# Wind Direction Display
scale = Slider(0.2, range=0..1)  # disabled
number_slider_6 = Slider(0.25, range=0..1)  # disabled
wind_direction = WindDirection(hoy=hoy.hoy, B=scale, north=north_2, epw_file=downloadepw.epw_file)  # -> R, C; disabled
compass = LBCompass(north=north_2, center=pt, scale=number_slider_6)  # -> compass; disabled; plug-in component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
vdisex = VectorDisplayEx(Point=pt, Vector=wind_direction.R, Colour=wind_direction.C, Width=5)  # disabled

# ----
# Normal Vector to Surface
normals = GhPythonScript(hb_objs=filter)  # -> points, vectors; inputs hb_objs: list; disabled
# ---------- normals: Python ----------
__author__ = "kenta"
__version__ = "2022.05.21"

# Rewrote Visual Normals to not include subsurfaces

try:  # import the core honeybee dependencies
    from honeybee.model import Model
    from honeybee.room import Room
    from honeybee.face import Face
    from honeybee.aperture import Aperture
    from honeybee.door import Door
    from honeybee.shade import Shade
except ImportError as e:
    raise ImportError('\nFailed to import honeybee:\n\t{}'.format(e))

try:  # import the ladybug_rhino dependencies
    from ladybug_rhino.fromgeometry import from_point3d, from_vector3d
    from ladybug_rhino.grasshopper import all_required_inputs
except ImportError as e:
    raise ImportError('\nFailed to import ladybug_rhino:\n\t{}'.format(e))


def add_door(door, points, vectors):
    """Add Door normals."""
    points.append(from_point3d(door.center))
    vectors.append(from_vector3d(door.normal))
    for shd in door.shades:
        points.append(from_point3d(shd.center))
        vectors.append(from_vector3d(shd.normal))

def add_aperture(aperture, points, vectors):
    """Add Aperture normals."""
    points.append(from_point3d(aperture.center))
    vectors.append(from_vector3d(aperture.normal))
    for shd in aperture.shades:
        points.append(from_point3d(shd.center))
        vectors.append(from_vector3d(shd.normal))

def add_face(face, points, vectors):
    """Add Face normals.
    Modified to only include face normals and not aperatures or doors"""
    points.append(from_point3d(face.center))
    vectors.append(from_vector3d(face.normal))

def add_room(room, points, vectors):
    """Add Room normals."""
    for face in room.faces:
        add_face(face, points, vectors)
    for shd in room.shades:
        points.append(from_point3d(shd.center))
        vectors.append(from_vector3d(shd.normal))

def add_model(model, points, vectors):
    """Add Model normals."""
    for room in model.rooms:
        add_room(room, points, vectors)
    for face in model.orphaned_faces:
        add_face(face, points, vectors)
    for ap in model.orphaned_apertures:
        add_aperture(ap, points, vectors)
    for dr in model.orphaned_doors:
        add_door(door, points, vectors)
    for shd in model.orphaned_shades:
        points.append(from_point3d(shd.center))
        vectors.append(from_vector3d(shd.normal))


if all_required_inputs(ghenv.Component):
    # list of rhino geometry to be filled with content
    points = []
    vectors = []

    # loop through all objects and add them
    for hb_obj in _hb_objs:
        if isinstance(hb_obj, Room):
            add_room(hb_obj, points, vectors)
        elif isinstance(hb_obj, Face):
            add_face(hb_obj, points, vectors)
        elif isinstance(hb_obj, Aperture):
            add_aperture(hb_obj, points, vectors)
        elif isinstance(hb_obj, Door):
            add_door(hb_obj, points, vectors)
        elif isinstance(hb_obj, Shade):
            points.append(from_point3d(hb_obj.center))
            vectors.append(from_vector3d(hb_obj.normal))
        elif isinstance(hb_obj, Model):
            add_model(hb_obj, points, vectors)
        else:
            raise TypeError(
                'Unrecognized honeybee object type: {}'.format(type(hb_obj)))
# ---------- end normals ----------

# ----
# Scale and Display Vector
scalar = Slider(1, range=0..20)  # disabled

vizairflow = VizAirflow(N=subtraction, nvector=normals.vectors, time=item_3, scalar=scalar)  # -> C, R; disabled

vdisex_2 = VectorDisplayEx(Point=normals.points, Vector=vizairflow.R, Colour=vizairflow.C, Width=3)  # disabled

# ==== cluster WindDirection
epw_file = ClusterInput()
importepw = LBImportEPW(epw_file=epw_file)  # -> location, dry_bulb_temperature, dew_point_temperature, relative_humidity, wind_speed, wind_direction, direct_normal_rad, diffuse_horizontal_rad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; plug-in component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
hoy = ClusterInput()
xdata = LBDeconstructData(data=importepw.wind_speed)  # -> header, values; plug-in component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
xdata_2 = LBDeconstructData(data=importepw.wind_direction)  # -> header, values; plug-in component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
hoy_2 = Data(hoy)
north = ClusterInput()
item = ListItem(List=xdata.values, Index=hoy_2, Wrap=True)
item_2 = ListItem(List=xdata_2.values, Index=hoy_2, Wrap=True)
subtraction = Subtraction(Wind_dir=item_2, North=north)
bnd = Bounds(Numbers=flatten(xdata.values))
vec = VectorXYZ(XComponent=0, YComponent="-1", ZComponent=0)  # -> Vector, Length
vec_2 = VectorXYZ(XComponent=0, YComponent=0, ZComponent="-1")  # -> Vector, Length
units = LBUnitConverter(values=subtraction, from_u="degrees", to_u="radians")  # -> all_u, values; plug-in component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
dedomain = DeconstructDomain(Domain=bnd)  # -> Start, End
vrot = Rotate(Vector=vec.Vector, Axis=vec_2.Vector, Angle=units.values)
gradient = Gradient(
    LowerLimit=dedomain.Start,
    UpperLimit=dedomain.End,
    Parameter=item,
    stops=[0: RGB(0, 128, 0), 0.5: RGB(255, 174, 0), 1: RGB(255, 0, 0)])
multiplication = Multiplication(A=vrot, B=item)
B = ClusterInput()
multiplication_2 = Multiplication(A=multiplication, B=B)
C = ClusterOutput(gradient)
R = ClusterOutput(multiplication_2)

# ==== cluster VizAirflow
time = ClusterInput()
nvector = ClusterInput()
multiplication = Multiplication(NVector=nvector, B=time)
scalar = ClusterInput()
N = ClusterInput()
multiplication_2 = Multiplication(A=multiplication, Scalar=scalar)
bnd = Bounds(Numbers=flatten(N))
R = ClusterOutput(multiplication_2)
abs = Absolute(Value=time)
dedomain = DeconstructDomain(Domain=bnd)  # -> Start, End
gradient = Gradient(
    LowerLimit=0,
    UpperLimit=dedomain.End,
    Parameter=abs,
    stops=[0: RGB(0, 128, 0), 0.5: RGB(255, 174, 0), 1: RGB(255, 0, 0)])
C = ClusterOutput(gradient)
