# Grasshopper definition TrueFlow_v9.gh (Grasshopper 1.0.7)

# ----
# Create a Building by Dragonfly
panel = Panel("12.5")
number_slider = Slider(15, range=15..45)
rectangle = Rectangle(Plane=PlaneXY(0, 0, 0), XSize=panel, YSize=panel, Radius=0)  # -> Rectangle, Length
Z = UnitZ(Factor=number_slider)
extr = Extrude(Base=rectangle.Rectangle, Direction=Z)
cap = CapHoles(Brep=extr)
buildingsolid = DFBuildingFromSolid(bldg_geo=flatten(cap), floor_to_floor="@3", perim_offset="3", run=Toggle(True))  # -> report, buildings; plug-in component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
model = DFModel(buildings=flatten(buildingsolid.buildings))  # -> report, model; plug-in component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

確認する風の方位 = ValueList({"N": 0, "NE": 1, "E": 2, "SE": 3, "S": 4, "SW": 5, "W": 6, "NW": 7}, selected="NE")

# ----
# Create Rooms
panel_2 = Panel("2013::LargeOffice::OpenOffice")  # disabled
# Ref
panel_3 = Panel("2013::ClimateZone3::SteelFramed")  # disabled
panel_4 = Panel("2019::LargeOffice::Lobby")  # disabled
toggle = BooleanToggle(True)  # disabled
panel_5 = Panel("OPEN_OFFICE")  # disabled
panel_6 = Panel("LOBBY")  # disabled
office = Geometry([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])  # disabled
lobby = Geometry(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)  # disabled
roomsolid = HBRoomFromSolid(geo=flatten(office), name=panel_5, constr_set=panel_3, program=panel_2, conditioned=toggle)  # -> report, rooms; disabled; plug-in component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
roomsolid_2 = HBRoomFromSolid(geo=flatten(lobby), name=panel_6, constr_set=panel_3, program=panel_4, conditioned=toggle)  # -> report, rooms; disabled; plug-in component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

Z_2 = Data(number_slider)
X = Data(panel)
Y = Data(panel)

# ----
# North
north = Slider(0, range=-360..360)  # disabled

Z_3 = Data(Z_2)
get_wind_pressure_coefficients = GetWindPressureCoefficients(height=Z_3, read=Button())  # -> out, wind_press_coeffs
# ---------- get_wind_pressure_coefficients: Python ----------
__author__ = "takahashi-yosh"

docs = "get wind pressure\ncoefficients"
ghenv.Component.Name = docs
ghenv.Component.NickName = docs
ghenv.Component.Message = docs
ghenv.Component.Category = docs

import rhinoscriptsyntax as rs
import os
import subprocess
import pickle

def list_to_tree(input, none_and_holes=True, source=[0]):
    """Transforms nestings of lists or tuples to a Grasshopper DataTree
    https://gist.github.com/piac/ef91ac83cb5ee92a1294
    """
    from Grasshopper import DataTree as Tree
    from Grasshopper.Kernel.Data import GH_Path as Path
    from System import Array
    def proc(input,tree,track):
        path = Path(Array[int](track))
        if len(input) == 0 and none_and_holes: tree.EnsurePath(path); return
        for i,item in enumerate(input):
            if hasattr(item, '__iter__'): #if list or tuple
                track.append(i); proc(item,tree,track); track.pop()
            else:
                if none_and_holes: tree.Insert(item,path,i)
                elif item is not None: tree.Add(item,path)
    if input is not None: t=Tree[object]();proc(input,t,source[:]);return t


MAINPATH = os.path.dirname(ghenv.LocalScope.ghdoc.Path)
print(MAINPATH)
cmd0 = os.path.join("C:/Program Files", "ladybug_tools", "python", "python")
cmd1 = os.path.join(MAINPATH, "get_wind_pressure_coefficients.py")
cmd2 = os.path.join(MAINPATH, "windpressurecoefficients.xlsx")
cmd3 = str(height)

if read:
    retcode = subprocess.call([cmd0, cmd1, cmd2, cmd3])

with open(os.path.join(MAINPATH, "data.pkl"), 'rb') as f:
    wind_press_coeffs = pickle.load(f)

if wind_press_coeffs:
    wind_press_coeffs = list_to_tree(wind_press_coeffs)
# ---------- end get_wind_pressure_coefficients ----------
path_mapper = PathMapper(get_wind_pressure_coefficients.wind_press_coeffs, source="{0;i}", target="{i}")
flip_matrix = FlipMatrix(Data=get_wind_pressure_coefficients.wind_press_coeffs)
flip_matrix_2 = FlipMatrix(Data=path_mapper)

# ----
# Solve Adjacency
panel_7 = Panel("AirBoundary")  # disabled
air_boundary = Geometry([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])  # disabled
panel_8 = Panel("Adiabatic")  # disabled
adiabatic = Geometry([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])  # disabled
guidesurface = HBPropertiesByGuideSurface(rooms=[roomsolid.rooms, roomsolid_2.rooms], guide=adiabatic, bc=panel_8)  # -> rooms; disabled; plug-in component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
guidesurface_2 = HBPropertiesByGuideSurface(rooms=guidesurface, guide=air_boundary, type=panel_7)  # -> rooms; disabled; plug-in component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
toggle_2 = BooleanToggle(True)  # disabled
solveadj = HBSolveAdjacency(rooms=flatten(guidesurface_2), run=toggle_2)  # -> report, adj_rooms; disabled; plug-in component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

wind_press_coeffs = Data(flip_matrix)

# ----
# To HB model
toggle_3 = BooleanToggle(False)
tohoneybee = DFModelToHoneybee(model=model.model, use_multiplier=toggle_3, run=Toggle(True))  # -> report, hb_models; plug-in component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

xlwings_installer = XlwingsInstaller(install=Toggle(False))  # -> out
# ---------- xlwings_installer: Python ----------
"""
lbt2webproのインストーラー
"""

desc = "xlwings\nInstaller"
ghenv.Component.Name = desc
ghenv.Component.NickName = desc
ghenv.Component.Message = desc

__author__ = "takahashi-yosh@nihonsekkei.co.jp"

import rhinoscriptsyntax as rs
import pickle
import os
import sys
import errno
import Rhino
from math import pi, sin, cos
import subprocess

log = []
MAINPATH = os.path.dirname(ghenv.LocalScope.ghdoc.Path)
if install:
    cmd1 = os.path.join("C:/Program Files", "ladybug_tools", "python", "python")
    retcode = subprocess.call([cmd1, "-m", "pip", "install", "xlwings"])
# ---------- end xlwings_installer ----------

panel_9 = Panel(flip_matrix_2)

# ----
# Add Glazings
deconstructmodel = HBDeconstructModel(model=tohoneybee.hb_models)  # -> rooms, faces, apertures, doors, shades; plug-in component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
aperturesbyratio = HBAperturesByRatio(
    hb_objs=flatten(deconstructmodel.rooms),
    ratio=Slider(0.4, range=0.1..0.9),
    subdivide=Toggle(True),
    win_height="2.5",
    sill_height="0.2",
    operable=Toggle(True))  # -> report, hb_objs; plug-in component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

decnstrobj = HBDeconstructObject(hb_obj=aperturesbyratio.hb_objs)  # -> faces, apertures, doors, shades; plug-in component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

# ----
# Create Windows
panel_10 = Panel("0.4")  # disabled
facparam = HBFacadeParameters(north=panel_10, east=0, south=panel_10, west=0)  # -> fac_par; disabled; plug-in component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
toggle_4 = BooleanToggle(True)  # disabled
aperturesbyratio_2 = HBAperturesByRatio(hb_objs=flatten(solveadj.adj_rooms), ratio=facparam, operable=toggle_4)  # -> report, hb_objs; disabled; plug-in component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

window_directions = WindowDirections(hb_objs=aperturesbyratio.hb_objs)  # -> out, dir, aperture_normal, aperture_dir, aperture_loc, aperture_center, aperture_identifier, hb_objs; inputs hb_objs: list
# ---------- window_directions: Python ----------
__author__ = "takahashi-yosh"
docs = "Window Directions"
ghenv.Component.Name = docs
ghenv.Component.NickName = docs
ghenv.Component.Message = docs
ghenv.Component.Category = docs
import rhinoscriptsyntax as rs
import math
room = hb_objs
aperture_normal = []
aperture_dir = []
aperture_loc = []
aperture_center = []
aperture_identifier = []
__dir = []
points = []

for room in hb_objs:
    for face in room.faces:
        __dir.append(face.display_name)
        
        x_vec = face.vertices[1] - face.vertices[0]
        y_vec = face.vertices[3] - face.vertices[0]
        face_divided_pts = [
            face.vertices[0] + 1/6 * x_vec + 1/6 * y_vec, 
            face.vertices[0] + 3/6 * x_vec + 1/6 * y_vec, 
            face.vertices[0] + 5/6 * x_vec + 1/6 * y_vec, 
            face.vertices[0] + 1/6 * x_vec + 3/6 * y_vec, 
            face.vertices[0] + 3/6 * x_vec + 3/6 * y_vec, 
            face.vertices[0] + 5/6 * x_vec + 3/6 * y_vec,
            face.vertices[0] + 1/6 * x_vec + 5/6 * y_vec, 
            face.vertices[0] + 3/6 * x_vec + 5/6 * y_vec, 
            face.vertices[0] + 5/6 * x_vec + 5/6 * y_vec,]
        
        for aperture in face.apertures:
            y = (0, 1, 0)
            n = aperture.normal
            angle = rs.VectorAngle(y, n)
            
            min_dist = 9999999
            loc = 0
            for i, fpt in enumerate(face_divided_pts):
                dist = rs.Distance(aperture.center, fpt)
                if dist < min_dist:
                    min_dist = dist
                    loc = i
            
                
            if n[0] <= 0:
                angle *= -1
                angle += 360
            aperture_normal.append(rs.CreateVector(aperture.normal.x, aperture.normal.y, aperture.normal.z))
            aperture_dir.append(angle)
            aperture_loc.append(loc)
            aperture_center.append(rs.CreatePoint(aperture.center.x, aperture.center.y, aperture.center.z))
            aperture_identifier.append(aperture.identifier)
            
            aperture.display_name = face.display_name + '_{:03.0f}_{}'.format(angle, loc)
            aperture.display_name = 'dir:{:03.0f}_loc:{}'.format(angle, loc)
# ---------- end window_directions ----------
vizwiref = HBVisualizeWireframe(hb_objs=flatten(aperturesbyratio.hb_objs))  # -> geo; plug-in component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
python = HBモデルチェック(data=decnstrobj.apertures)  # -> names, normals; inputs data: list
# ---------- python: Python ----------
import rhinoscriptsyntax as rs
names = None
normals = None
names = []
normals = []

if data:
    for d in data:
        name = d.display_name
        names.append(name)
        normal = d.normal
        normals.append(normal)
# ---------- end python ----------

# ----
# Add AirBoundary
vizbytype = HBVisualizeByType(hb_objs=aperturesbyratio.hb_objs)  # -> walls, interior_walls, roofs, ceilings, exterior_floors, interior_floors, air_walls, apertures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; plug-in component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
geo = Geometry(vizbytype.interior_walls)
guidesurface_3 = HBPropertiesByGuideSurface(rooms=aperturesbyratio.hb_objs, guide=geo, type="AirBoundary")  # -> rooms; plug-in component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

panel_11 = Panel(python.names)

# ----
# Assing Window Ventilation
# Control Strategy
panel_12 = Panel("60")  # disabled
panel_13 = Panel("23")  # disabled
applysetpointvals = HBApplySetpointValues(room_or_program=flatten(aperturesbyratio_2.hb_objs), cooling_setpt=panel_12)  # -> report, mod_obj; disabled; plug-in component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
ventcontrol = HBVentilationControl(min_in_temp=panel_13)  # -> vent_cntrl; disabled; plug-in component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
windowopen = HBWindowOpening(rooms=flatten(applysetpointvals.mod_obj), vent_cntrl=ventcontrol)  # -> report, rooms; disabled; plug-in component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

vizbytype_2 = HBVisualizeByType(hb_objs=guidesurface_3)  # -> walls, interior_walls, roofs, ceilings, exterior_floors, interior_floors, air_walls, apertures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; plug-in component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

# ----
# Visualize Model
vizbytype_3 = HBVisualizeByType(hb_objs=aperturesbyratio_2.hb_objs)  # -> walls, interior_walls, roofs, ceilings, exterior_floors, interior_floors, air_walls, apertures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; disabled; plug-in component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

geo_2 = Geometry([vizbytype_3.apertures, vizbytype_3.wire_frame, vizbytype_3.air_walls])  # disabled

# ----
# Assing Window Ventilation
# Control Strategy
applysetpointvals_2 = HBApplySetpointValues(room_or_program=flatten(guidesurface_3), cooling_setpt="60")  # -> report, mod_obj; plug-in component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
ventcontrol_2 = HBVentilationControl(min_in_temp="23")  # -> vent_cntrl; plug-in component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
windowopen_2 = HBWindowOpening(rooms=flatten(applysetpointvals_2.mod_obj), vent_cntrl=ventcontrol_2)  # -> report, rooms; plug-in component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

# ----
# Download EPW File
panel_14 = Panel("https://energyplus-weather.s3.amazonaws.com/north_and_central_america_wmo_region_4/USA/MA/USA_MA_Boston-Logan.Intl.AP.725090_TMY3/USA_MA_Boston-Logan.Intl.AP.725090_TMY3.zip")  # disabled
downloadepw = LBDownloadWeather(weather_URL=panel_14)  # -> epw_file, stat_file, ddy_file; disabled; plug-in component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

# ----
# Setup the Model with the Airflow Network
panel_15 = Panel("AFN_Office")  # disabled
model_2 = HBModel(rooms=flatten(windowopen.rooms), name=panel_15)  # -> report, model; disabled; plug-in component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
toggle_5 = BooleanToggle(True)  # disabled
afn = HBAirflowNewtwork(model=model_2.model, high_rise=toggle_5)  # -> report, model; disabled; plug-in component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

afn_flow = Text(["AFN Linkage Node 1 to Node 2 Volume Flow Rate", "AFN Linkage Node 2 to Node 1 Volume Flow Rate"])  # disabled
vizbytype_4 = HBVisualizeByType(hb_objs=applysetpointvals_2.mod_obj)  # -> walls, interior_walls, roofs, ceilings, exterior_floors, interior_floors, air_walls, apertures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; plug-in component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

# ----
# Setup the Model with the Airflow Network
panel_16 = Panel("TrueFlow-sample")
model_3 = HBModel(rooms=flatten(windowopen_2.rooms), name=panel_16)  # -> report, model; plug-in component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
afn_2 = HBAirflowNewtwork(model=model_3.model, high_rise=Toggle(True))  # -> report, model; plug-in component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

data = Data(vizbytype_4.air_walls)

X_2 = Data(X)
Y_2 = Data(Y)
Z_4 = Data(Z_2)

# ----
# Setup the grid
panel_17 = Panel("0,0,0")
box = Box2Pt(PointA=panel_17, PointB="1,1,1", Plane=PlaneXY(0, 0, 0))
bbox = BoundingBox(Content=box, Plane=PlaneXY(0, 0, 0), UnionBox=True)  # -> Box, Box_2
debrep = DeconstructBrep(Brep=bbox.Box_2)  # -> Faces, Edges, Vertices
item = ListItem(List=debrep.Faces, Index=0, Wrap=True)  # -> Item, Item1, Item2, Item3
number_slider_2 = Slider(4, range=0..10)
merge = Merge(Data1=item.Item, Data2=item.Item1, Data3=item.Item2, Data4=item.Item3)
sdivide = DivideSurface(Surface=merge, UCount=number_slider_2, VCount=number_slider_2)  # -> Points, Normals, Parameters
genpts = LBGeneratePointGrid(geometry=merge, grid_size="0.333")  # -> points, vectors, face_areas, mesh; plug-in component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
panel_18 = Panel("""0
3
6
1
4
7
2
5
8""")
scale_nu = ScaleNU(Geometry=genpts.mesh, Plane=PlaneXY(0, 0, 0), ScaleX=X_2, ScaleY=Y_2, ScaleZ=Z_4)  # -> Geometry, Transform
scale_nu_2 = ScaleNU(Geometry=genpts.points, Plane=PlaneXY(0, 0, 0), ScaleX=X_2, ScaleY=Y_2, ScaleZ=Z_4)  # -> Geometry, Transform
heatmap = LBSpatialHeatmap(values=panel_18, mesh=scale_nu.Geometry)  # -> mesh, legend, title, colors, legend_par; plug-in component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
sort = SortList(Keys=panel_18, ValuesA=scale_nu_2.Geometry)  # -> Keys, ValuesA
sort_2 = SortList(Keys=panel_18, ValuesA=genpts.vectors)  # -> Keys, ValuesA
panel_19 = Panel(sort_2.ValuesA)

aperture_properties = ApertureProperties(model=afn_2.model, grid_pts=flatten(sort.ValuesA), grid_vecs=flatten(sort_2.ValuesA))  # -> out, d, model, aperture_identifier, aperture_loc, aperture_dir, aperture_normal, aperture_center; inputs grid_pts: list of Point3d, grid_vecs: list of Vector3d
# ---------- aperture_properties: Python ----------
__author__ = "takahashi-yosh"

docs = "Aperture Properties"
ghenv.Component.Name = docs
ghenv.Component.NickName = docs
ghenv.Component.Message = docs
ghenv.Component.Category = docs

import rhinoscriptsyntax as rs

# written by Giulio Piacentino, giulio@mcneel.com
def tree_to_list(input, retrieve_base = lambda x: x[0]):
    """Returns a list representation of a Grasshopper DataTree
    https://gist.github.com/piac/ef91ac83cb5ee92a1294"""
    def extend_at(path, index, simple_input, rest_list):
        target = path[index]
        if len(rest_list) <= target: rest_list.extend([None]*(target-len(rest_list)+1))
        if index == path.Length - 1:
            rest_list[target] = list(simple_input)
        else:
            if rest_list[target] is None: rest_list[target] = []
            extend_at(path, index+1, simple_input, rest_list[target])
    all = []
    for i in range(input.BranchCount):
        path = input.Path(i)
        extend_at(path, 0, input.Branch(path), all)
    return retrieve_base(all)

aperture_normal = []
aperture_dir = []
aperture_loc = []
aperture_center = []
aperture_identifier = []
points = []
__d = dir(model)

grid_pts_set = {}
for pt, vec in zip(grid_pts, grid_vecs):
    __d = dir(vec)
    key = (vec.X, vec.Y, vec.Z)
    if key in grid_pts_set:
        grid_pts_set[key].append(pt)
    else:
        grid_pts_set[key] = [pt]

idap = 0
for room in model.rooms:
    for face in room.faces:
        for iaperture, aperture in enumerate(face.apertures):
            face_divided_pts = None
            for i, (key, value) in enumerate(grid_pts_set.items()):
                ang = rs.VectorAngle(key, aperture.normal)
                if ang < 1:
                    face_divided_pts = value
                    continue
                    

            
            min_dist = 9999999
            loc = 0
            for iloc, fpt in enumerate(face_divided_pts):
                dist = rs.Distance(aperture.center, fpt)
                if dist < min_dist:
                    min_dist = dist
                    
                    loc = iloc
            
            print(aperture.center, (fpt.X, fpt.Y, fpt.Z))
            print(loc)
            print(min_dist)
            
            angle = rs.VectorAngle((0, 1, 0), aperture.normal)
            if aperture.normal[0] <= 0:
                angle *= -1
                angle += 360
            aperture_normal.append(rs.CreateVector(aperture.normal.x, aperture.normal.y, aperture.normal.z))
            aperture_dir.append(angle)
            aperture_loc.append(loc)
            aperture_center.append(rs.CreatePoint(aperture.center.x, aperture.center.y, aperture.center.z))
            
            aperture.display_name = '{}:{}'.format(face.cardinal_direction(), loc)
            
            aperture.identifier = '{}_{}_Aperture_{}'.format(
                room.display_name, face.cardinal_direction(), iaperture)
            aperture.identifier = 'Aperture_{}'.format(idap)
            aperture.display_name = aperture.identifier
            idap += 1
            aperture_identifier.append(aperture.identifier)
# ---------- end aperture_properties ----------
division = Division(A=aperture_properties.aperture_dir, B="90")
subtraction = Subtraction(A=division, B="1")
multiplication = Multiplication(A="8", B=subtraction)
addition = Addition(A=aperture_properties.aperture_loc, B=multiplication)
tree_item = TreeItem(Tree=flip_matrix_2, Path=addition, Index=確認する風の方位, Wrap=True)
pick_numbers = Data(addition)
panel_20 = Panel(addition)
multiplication_2 = Multiplication(A=tree_item, B="10")
negative = Negative(Value=multiplication_2)
gradient = Gradient(
    LowerLimit="0.8",
    UpperLimit="-0.8",
    Parameter=tree_item,
    stops=[0: RGB(234, 38, 0), 0.25: RGB(234, 126, 0), 0.5: RGB(254, 244, 84), 0.75: RGB(173, 203, 249), 1: RGB(75, 107, 169)])
amplitude = Amplitude(Vector=window_directions.aperture_normal, Amplitude=negative)
vector_display_ex = VectorDisplayEx(Point=window_directions.aperture_center, Vector=amplitude, Colour=gradient, Width="5")

# ----
# Visualize the assigned number by apertures
faceattr = HBFaceAttributes({"Display Name": "display_name", "Simulation Name (Identifier)": "identifier", "Boundary Condition": "boundary_condition", "Has Parent": "has_parent", "Parent": "parent", "Area": "area", "Perimeter": "perimeter", "Face Type": "type", "Aperture Is Operable": "is_operable", "Door Is Glass": "is_glass"}, selected="Display Name")
lablefaces = HBLabelFaces(
    hb_objs=flatten(aperture_properties.model),
    attribute=faceattr,
    sub_faces=Toggle(True),
    txt_height=Slider(0.1, range=0..5))  # -> label_text, base_pts, labels, wire_frame; plug-in component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

# ----
# Center
pt = Point(Point(16, 9, 0))  # disabled

# ----
# North
north_2 = Data(north)  # disabled

# ----
# Pick time
number_slider_3 = Slider(8, range=1..12)  # disabled
number_slider_4 = Slider(14, range=0..23)  # disabled
number_slider_5 = Slider(30, range=1..31)  # disabled

analysisperiod = LBAnalysisPeriod(start_month="6", start_day=1, start_hour=0, end_month="7")  # -> period, hoys, dates; plug-in component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

toggle_6 = BooleanToggle(True)
simoutput = HBSimulationOutput(gains_and_losses=toggle_6, comfort_metrics=toggle_6)  # -> report, sim_output; plug-in component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
afn_flow_2 = Text(["AFN Linkage Node 1 to Node 2 Volume Flow Rate", "AFN Linkage Node 2 to Node 1 Volume Flow Rate"])
customoutput = HBCustomSimulationOutput(base_sim_output=simoutput.sim_output, output_names=afn_flow_2)  # -> report, sim_output; plug-in component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
simpar = HBSimulationParameter(north="0", output=customoutput.sim_output, run_period=analysisperiod.period, timestep=6)  # -> sim_par; plug-in component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

# ----
# EPW
panel_21 = Panel("C:\Users\kenta\Desktop\TrueFlow\TrueFlow\gh_files\TrueFlow\Tokyo_EA2010StandardYear_ver2.epw")
panel_22 = Panel(aperture_properties.aperture_identifier)
modeltoosm = HBModelToOSM(model=aperture_properties.model, epw_file=panel_21, sim_par=simpar, write=Toggle(True), run="2")  # -> report, jsons, osw, osm, idf, sql, zsz, rdd, html; plug-in component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
pick_numbers_2 = Data(pick_numbers)
wind_press_coeffs_2 = Data(wind_press_coeffs)
python_2 = GhPythonScript(
    osm=modeltoosm.osm,
    run=Toggle(True),
    aperture_identifier=panel_22,
    wind_press_coeffs=wind_press_coeffs_2,
    pick_numbers=pick_numbers_2)  # -> out, dir, osm; inputs run: Boolean, aperture_identifier: list, wind_press_coeffs: tree, pick_numbers: list
# ---------- python_2: Python ----------
from ladybug_rhino.grasshopper import all_required_inputs
from ladybug_rhino.openstudio import load_osm, dump_osm, import_openstudio

OpenStudio = import_openstudio()

def get_osm_data(param):
    if param.is_initialized():
        return param.get()
    else:
        return False
"""
N  = 0
NE = 1
E  = 2
SE = 3
S  = 4
SW = 5
W  = 6
NW = 7
"""

import ghpythonlib.treehelpers as th

wind_press_coeffs = th.tree_to_list(wind_press_coeffs)

l = []
if all_required_inputs(ghenv.Component) and _run:
    # load the Model from the OSM
    model = load_osm(_osm)

    # change the simulation control to use detailed pressur input
    afn_control = model.getAirflowNetworkSimulationControl()
    afn_control.setWindPressureCoefficientType('Input')
    afn_control.setHeightSelectionforLocalWindPressureCalculation('ExternalNode')
    
    
    
        
        
        # get all of the AirflowNetworkSurfaces and set their properties
    afn_surfaces = model.getAirflowNetworkSurfaces()
    for afn_srf in afn_surfaces:
        if afn_srf.surface() and afn_srf.surface().name():
            srf_name = afn_srf.surface().name().get()
            
            flag = True
            for apid, pick in zip(aperture_identifier, pick_numbers):
                wpcs = wind_press_coeffs[pick]
                if not apid == srf_name: continue
                
                print('{}_afn_node'.format(apid))
                l.append('{}_afn_node'.format(apid))
                
                e_node = OpenStudio.AirflowNetworkExternalNode(model)
                e_node.setName('{}_afn_node'.format(apid))
                
                press_table = OpenStudio.TableMultiVariableLookup(model,1)
                for wpc, ang in zip(wpcs, list(range(0, 360, 45))):
                    press_table.addPoint(ang, wpc)
                    
                e_node.setWindPressureCoefficientCurve(press_table)
                afn_srf.setExternalNode(e_node)
                flag = False
                break
                
            if flag:
                # __dir = [d for d in dir(afn_srf.surface()) if 'type' in d.lower()]
                e_node = OpenStudio.AirflowNetworkExternalNode(model)
                e_node.setName('{}_afn_node'.format(srf_name))
                press_table = OpenStudio.CurveLinear(model)
                press_table.setMinimumValueofx(0)
                press_table.setMaximumValueofx(360)
                press_table.setCoefficient1Constant(0.1)
                press_table.setCoefficient2x(0)
                e_node.setWindPressureCoefficientCurve(press_table)
                afn_srf.setExternalNode(e_node)


    # save the edited OSM over the original one
    osm = dump_osm(model, _osm)
# ---------- end python_2 ----------
toggle_7 = BooleanToggle(True)
runosm = HBRunOSM(osm=python_2.osm, epw_file=panel_21, translate=toggle_7, run=toggle_7)  # -> report, idf, sql, zsz, rdd, html; plug-in component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
panel_23 = Panel(runosm.idf)

# ----
# Net Airflow
bang = ExplodeTree(Data=graft(Tree({0;0}: ["AFN Linkage Node 1 to Node 2 Volume Flow Rate"], {0;1}: ["AFN Linkage Node 2 to Node 1 Volume Flow Rate"])))  # -> Branch0, Branch1
customresult = HBReadCustomResult(sql=runosm.sql, output_names=bang.Branch0)  # -> results; plug-in component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
customresult_2 = HBReadCustomResult(sql=runosm.sql, output_names=bang.Branch1)  # -> results; plug-in component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
xdata = LBDeconstructData(data=customresult_2)  # -> header, values; plug-in component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
xdata_2 = LBDeconstructData(data=customresult)  # -> header, values; plug-in component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
subtraction_2 = Subtraction(A=xdata_2.values, B=xdata.values)

x = Object(model=aperture_properties.model)  # -> hbobjs
# ---------- x: Python ----------
__author__ = "takahashi-yosh"

docs = ""
ghenv.Component.Name = docs
ghenv.Component.NickName = docs
ghenv.Component.Message = docs
ghenv.Component.Category = docs

import rhinoscriptsyntax as rs
hbobjs = [r for r in model.rooms]
# ---------- end x ----------

# ----
# Filter surfaces
decnstrobj_2 = HBDeconstructObject(hb_obj=x)  # -> faces, apertures, doors, shades; plug-in component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
filter = GhPythonScript(faces=flatten([decnstrobj_2.faces, decnstrobj_2.apertures, decnstrobj_2.doors]), header=xdata_2.header)  # -> surfaces, AFN_header; inputs faces: list, header: list
# ---------- filter: Python ----------
"""Filters and sorts airflow surfaces based on the airflow data headers.
    Inputs:
        faces: Deconstructed faces from honeybee.
        airflow: The string of face identifiers from airflow network results.
    Output:
        surfaces: The sorted list of surfaces that contain airflow data"""

__author__ = "kenta"
__version__ = "2021.10.26"

# Read surface names from AFN header
AFN_header = [header[i].metadata['System'] for i in range(len(header))]

# Filter only surfaces with airflow results
surfaces = []
srf_ID = []
for face in faces:
    face_id = face.identifier.upper()
    if face_id in AFN_header:
        surfaces.append(face)
        srf_ID.append(face_id)
#print(len(faces))
#print(len(face_id))
#print(len(AFN_header))
#print(face_id)

# Sort surfaces to match AFN results
index = []
for id in AFN_header:
    print(srf_ID.index(id))
    index.append(srf_ID.index(id))
surfaces = [surfaces[i] for i in index]
# ---------- end filter ----------

# ----
# Center
pt_2 = Point(Point(23.29310325, 5.727069949, 0))

# ----
# North
north_3 = Data(0)

# ----
# Pick time
number_slider_6 = Slider(6, range=1..12)

hoy = LBCalculateHOY(month=number_slider_6, day=Slider(15, range=1..31), hour=Slider(15, range=0..23))  # -> flatten(hoy), flatten(doy), flatten(date); plug-in component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
item_2 = ListItem(List=analysisperiod.hoys, Index=0, Wrap=True)  # -> Item, Item1, Item2
subtraction_3 = Subtraction(A=hoy.hoy, B=item_2.Item)
item_3 = ListItem(List=subtraction_2, Index=subtraction_3, Wrap=True)  # -> flatten(Item)

# ----
# Wind Direction Display
scale = Slider(1, range=0..1)
wind_direction = WindDirection(hoy=hoy.hoy, B=scale, north=north_3, epw_file=panel_21)  # -> R, C
compass = LBCompass(north=north_3, center=pt_2, scale=Slider(0.25, range=0..1))  # -> compass; plug-in component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
vdisex = VectorDisplayEx(Point=pt_2, Vector=wind_direction.R, Colour=wind_direction.C, Width=5)

# ----
# Normal Vector to Surface
normals = GhPythonScript(hb_objs=filter.surfaces)  # -> points, vectors; inputs hb_objs: list
# ---------- normals: Python ----------
__author__ = "kenta"
__version__ = "2022.05.21"

# Rewrote Visual Normals to not include subsurfaces

try:  # import the core honeybee dependencies
    from honeybee.model import Model
    from honeybee.room import Room
    from honeybee.face import Face
    from honeybee.aperture import Aperture
    from honeybee.door import Door
    from honeybee.shade import Shade
except ImportError as e:
    raise ImportError('\nFailed to import honeybee:\n\t{}'.format(e))

try:  # import the ladybug_rhino dependencies
    from ladybug_rhino.fromgeometry import from_point3d, from_vector3d
    from ladybug_rhino.grasshopper import all_required_inputs
except ImportError as e:
    raise ImportError('\nFailed to import ladybug_rhino:\n\t{}'.format(e))


def add_door(door, points, vectors):
    """Add Door normals."""
    points.append(from_point3d(door.center))
    vectors.append(from_vector3d(door.normal))
    for shd in door.shades:
        points.append(from_point3d(shd.center))
        vectors.append(from_vector3d(shd.normal))

def add_aperture(aperture, points, vectors):
    """Add Aperture normals."""
    points.append(from_point3d(aperture.center))
    vectors.append(from_vector3d(aperture.normal))
    for shd in aperture.shades:
        points.append(from_point3d(shd.center))
        vectors.append(from_vector3d(shd.normal))

def add_face(face, points, vectors):
    """Add Face normals.
    Modified to only include face normals and not aperatures or doors"""
    points.append(from_point3d(face.center))
    vectors.append(from_vector3d(face.normal))

def add_room(room, points, vectors):
    """Add Room normals."""
    for face in room.faces:
        add_face(face, points, vectors)
    for shd in room.shades:
        points.append(from_point3d(shd.center))
        vectors.append(from_vector3d(shd.normal))

def add_model(model, points, vectors):
    """Add Model normals."""
    for room in model.rooms:
        add_room(room, points, vectors)
    for face in model.orphaned_faces:
        add_face(face, points, vectors)
    for ap in model.orphaned_apertures:
        add_aperture(ap, points, vectors)
    for dr in model.orphaned_doors:
        add_door(door, points, vectors)
    for shd in model.orphaned_shades:
        points.append(from_point3d(shd.center))
        vectors.append(from_vector3d(shd.normal))


if all_required_inputs(ghenv.Component):
    # list of rhino geometry to be filled with content
    points = []
    vectors = []

    # loop through all objects and add them
    for hb_obj in _hb_objs:
        if isinstance(hb_obj, Room):
            add_room(hb_obj, points, vectors)
        elif isinstance(hb_obj, Face):
            add_face(hb_obj, points, vectors)
        elif isinstance(hb_obj, Aperture):
            add_aperture(hb_obj, points, vectors)
        elif isinstance(hb_obj, Door):
            add_door(hb_obj, points, vectors)
        elif isinstance(hb_obj, Shade):
            points.append(from_point3d(hb_obj.center))
            vectors.append(from_vector3d(hb_obj.normal))
        elif isinstance(hb_obj, Model):
            add_model(hb_obj, points, vectors)
        else:
            raise TypeError(
                'Unrecognized honeybee object type: {}'.format(type(hb_obj)))
# ---------- end normals ----------

vlen = VectorLength(Vector=wind_direction.R)
panel_24 = Panel(vlen)

# ----
# Request Outputs
toggle_8 = BooleanToggle(True)  # disabled
simoutput_2 = HBSimulationOutput(gains_and_losses=toggle_8, comfort_metrics=toggle_8)  # -> report, sim_output; disabled; plug-in component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
panel_25 = Panel("9")  # disabled
panel_26 = Panel("6")  # disabled
analysisperiod_2 = LBAnalysisPeriod(start_month=panel_26, start_day=1, start_hour=0, end_month=panel_25)  # -> period, hoys, dates; disabled; plug-in component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

customoutput_2 = HBCustomSimulationOutput(base_sim_output=simoutput_2.sim_output, output_names=afn_flow)  # -> report, sim_output; disabled; plug-in component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

simpar_2 = HBSimulationParameter(north=north, output=customoutput_2.sim_output, run_period=analysisperiod_2.period, timestep=6)  # -> sim_par; disabled; plug-in component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

# ----
# Run
toggle_9 = BooleanToggle(True)  # disabled
modeltoosm_2 = HBModelToOSM(model=afn.model, epw_file=downloadepw.epw_file, sim_par=simpar_2, write=toggle_9, run=toggle_9)  # -> report, jsons, osw, osm, idf, sql, zsz, rdd, html; disabled; plug-in component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

# ----
# Net Airflow
bang_2 = ExplodeTree(Data=graft(Tree({0;0}: ["AFN Linkage Node 1 to Node 2 Volume Flow Rate"], {0;1}: ["AFN Linkage Node 2 to Node 1 Volume Flow Rate"])))  # -> Branch0, Branch1; disabled
customresult_3 = HBReadCustomResult(sql=modeltoosm_2.sql, output_names=bang_2.Branch0)  # -> results; disabled; plug-in component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
customresult_4 = HBReadCustomResult(sql=modeltoosm_2.sql, output_names=bang_2.Branch1)  # -> results; disabled; plug-in component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
xdata_3 = LBDeconstructData(data=customresult_4)  # -> header, values; disabled; plug-in component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
xdata_4 = LBDeconstructData(data=customresult_3)  # -> header, values; disabled; plug-in component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
subtraction_4 = Subtraction(A=xdata_4.values, B=xdata_3.values)  # disabled

# ----
# Filter surfaces
decnstrobj_3 = HBDeconstructObject(hb_obj=windowopen.rooms)  # -> faces, apertures, doors, shades; disabled; plug-in component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
filter_2 = GhPythonScript(faces=flatten([decnstrobj_3.faces, decnstrobj_3.apertures, decnstrobj_3.doors]), header=xdata_4.header)  # -> surfaces; inputs faces: list, header: list; disabled
# ---------- filter_2: Python ----------
"""Filters and sorts airflow surfaces based on the airflow data headers.
    Inputs:
        faces: Deconstructed faces from honeybee.
        airflow: The string of face identifiers from airflow network results.
    Output:
        surfaces: The sorted list of surfaces that contain airflow data"""

__author__ = "kenta"
__version__ = "2021.10.26"

# Read surface names from AFN header
AFN_header = [header[i].metadata['System'] for i in range(len(header))]

# Filter only surfaces with airflow results
surfaces = []
srf_ID = []
for face in faces:
    face_id = face.identifier.upper()
    if face_id in AFN_header:
        surfaces.append(face)
        srf_ID.append(face_id)

# Sort surfaces to match AFN results
index = []
for id in AFN_header:
    index.append(srf_ID.index(id))
surfaces = [surfaces[i] for i in index]
# ---------- end filter_2 ----------

hoy_2 = LBCalculateHOY(month=number_slider_3, day=number_slider_5, hour=number_slider_4)  # -> flatten(hoy), flatten(doy), flatten(date); disabled; plug-in component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
item_4 = ListItem(List=analysisperiod_2.hoys, Index=0, Wrap=True)  # disabled
subtraction_5 = Subtraction(A=hoy_2.hoy, B=item_4)  # disabled
item_5 = ListItem(List=subtraction_4, Index=subtraction_5, Wrap=True)  # -> flatten(Item); disabled

# ----
# Wind Direction Display
scale_2 = Slider(0.2, range=0..1)  # disabled
number_slider_7 = Slider(0.25, range=0..1)  # disabled
wind_direction_2 = WindDirection(hoy=hoy_2.hoy, B=scale_2, north=north_2, epw_file=downloadepw.epw_file)  # -> R, C; disabled
compass_2 = LBCompass(north=north_2, center=pt, scale=number_slider_7)  # -> compass; disabled; plug-in component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
vdisex_2 = VectorDisplayEx(Point=pt, Vector=wind_direction_2.R, Colour=wind_direction_2.C, Width=5)  # disabled

# ----
# Normal Vector to Surface
normals_2 = GhPythonScript(hb_objs=filter_2)  # -> points, vectors; inputs hb_objs: list; disabled; same code as normals

# ----
# Scale and Display Vector
scalar = Slider(1, range=0..20)  # disabled

vizairflow = VizAirflow(N=subtraction_4, nvector=normals_2.vectors, time=item_5, scalar=scalar)  # -> C, R; disabled

vdisex_3 = VectorDisplayEx(Point=normals_2.points, Vector=vizairflow.R, Colour=vizairflow.C, Width=3)  # disabled

# ----
# Scale and Display Vector
scalar_2 = Slider(1226.4, range=0..20000)

vizairflow_2 = VizAirflow_2(N=subtraction_2, nvector=normals.vectors, time=item_3, scalar=scalar_2)  # -> C, R

vdisex_4 = VectorDisplayEx(Point=normals.points, Vector=vizairflow_2.R, Colour=vizairflow_2.C, Width=3)

# ==== cluster WindDirection
epw_file = ClusterInput()
importepw = LBImportEPW(epw_file=epw_file)  # -> location, dry_bulb_temperature, dew_point_temperature, relative_humidity, wind_speed, wind_direction, direct_normal_rad, diffuse_horizontal_rad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; plug-in component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
hoy = ClusterInput()
xdata = LBDeconstructData(data=importepw.wind_speed)  # -> header, values; plug-in component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
xdata_2 = LBDeconstructData(data=importepw.wind_direction)  # -> header, values; plug-in component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
hoy_2 = Data(hoy)
north = ClusterInput()
item = ListItem(List=xdata.values, Index=hoy_2, Wrap=True)
item_2 = ListItem(List=xdata_2.values, Index=hoy_2, Wrap=True)
subtraction = Subtraction(Wind_dir=item_2, North=north)
bnd = Bounds(Numbers=flatten(xdata.values))
vec = VectorXYZ(XComponent=0, YComponent="-1", ZComponent=0)  # -> Vector, Length
vec_2 = VectorXYZ(XComponent=0, YComponent=0, ZComponent="-1")  # -> Vector, Length
units = LBUnitConverter(values=subtraction, from_u="degrees", to_u="radians")  # -> all_u, values; plug-in component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
dedomain = DeconstructDomain(Domain=bnd)  # -> Start, End
vrot = Rotate(Vector=vec.Vector, Axis=vec_2.Vector, Angle=units.values)
gradient = Gradient(
    LowerLimit=dedomain.Start,
    UpperLimit=dedomain.End,
    Parameter=item,
    stops=[0: RGB(0, 128, 0), 0.5: RGB(255, 174, 0), 1: RGB(255, 0, 0)])
multiplication = Multiplication(A=vrot, B=item)
B = ClusterInput()
multiplication_2 = Multiplication(A=multiplication, B=B)
C = ClusterOutput(gradient)
R = ClusterOutput(multiplication_2)

# ==== cluster VizAirflow
time = ClusterInput()
nvector = ClusterInput()
multiplication = Multiplication(NVector=nvector, B=time)
scalar = ClusterInput()
N = ClusterInput()
multiplication_2 = Multiplication(A=multiplication, Scalar=scalar)
bnd = Bounds(Numbers=flatten(N))
R = ClusterOutput(multiplication_2)
abs = Absolute(Value=time)
dedomain = DeconstructDomain(Domain=bnd)  # -> Start, End
gradient = Gradient(
    LowerLimit=0,
    UpperLimit=dedomain.End,
    Parameter=abs,
    stops=[0: RGB(0, 128, 0), 0.5: RGB(255, 174, 0), 1: RGB(255, 0, 0)])
C = ClusterOutput(gradient)

# ==== cluster VizAirflow_2
time = ClusterInput()
nvector = ClusterInput()
multiplication = Multiplication(NVector=nvector, B=time)
scalar = ClusterInput()
N = ClusterInput()
multiplication_2 = Multiplication(A=multiplication, Scalar=scalar)
bnd = Bounds(Numbers=flatten(N))
abs = Absolute(Value=time)
dedomain = DeconstructDomain(Domain=bnd)  # -> Start, End
R = ClusterOutput(multiplication_2)
gradient = Gradient(
    LowerLimit=0,
    UpperLimit=dedomain.End,
    Parameter=abs,
    stops=[0: RGB(0, 128, 0), 0.5: RGB(255, 174, 0), 1: RGB(255, 0, 0)])
C = ClusterOutput(gradient)
