# Grasshopper definition sample_ext_nodes_in_afn.gh (Grasshopper 1.0.7)

geo = Geometry(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)
geo_2 = Geometry(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)
face = HBFace(geo=geo, bc="adiabatic")  # -> report, faces; plug-in component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
face_2 = HBFace(geo=geo_2, bc="outdoors")  # -> report, faces; plug-in component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
room = HBRoom(
    faces=flatten([face.faces, face_2.faces]),
    name="Living Space",
    constr_set="2013::ClimateZone5::SteelFramed",
    program="2013::MidriseApartment::Apartment",
    conditioned=True)  # -> report, room; plug-in component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

geo_3 = Geometry(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)
geo_4 = Geometry([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])
face_3 = HBFace(geo=geo_3, bc="adiabatic")  # -> report, faces; plug-in component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
face_4 = HBFace(geo=geo_4, bc="outdoors")  # -> report, faces; plug-in component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
room_2 = HBRoom(
    faces=flatten([face_3.faces, face_4.faces]),
    name="Bedroom",
    constr_set="2013::ClimateZone5::SteelFramed",
    program="2013::MidriseApartment::Apartment",
    conditioned=True)  # -> report, room; plug-in component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

geo_5 = Geometry(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)
# Create Honeybee Rooms
geo_6 = Geometry(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)
face_5 = HBFace(geo=geo_5, bc="adiabatic")  # -> report, faces; plug-in component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
face_6 = HBFace(geo=geo_6, bc="outdoors")  # -> report, faces; plug-in component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
room_3 = HBRoom(
    faces=flatten([face_5.faces, face_6.faces]),
    name="Loft",
    constr_set="2013::ClimateZone5::SteelFramed",
    program="2013::MidriseApartment::Apartment",
    conditioned=True)  # -> report, room; plug-in component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

# ----
# Solve Air Wall
# Adjacency
toggle = BooleanToggle(True)
solveadj = HBSolveAdjacency(rooms=flatten([room_3.room, room.room]), air_boundary=toggle, run=Toggle(True))  # -> report, adj_rooms; plug-in component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

# ----
# Assign
# Windows
# and Doors
toggle_2 = BooleanToggle(True)
geo_7 = Geometry(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)
geo_8 = Geometry([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])
aperture = HBAperture(geo=geo_8, operable=toggle_2)  # -> report, apertures; plug-in component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
door = HBDoor(geo=geo_7)  # -> report, doors; plug-in component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
addsubface = HBAddSubface(hb_obj=flatten([solveadj.adj_rooms, room_2.room]), sub_faces=flatten([aperture.apertures, door.doors]))  # -> hb_obj; plug-in component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

# ----
# Solve Interior
# Window
# Adjacency
toggle_3 = BooleanToggle(True)
solveadj_2 = HBSolveAdjacency(rooms=flatten(addsubface), run=toggle_3)  # -> report, adj_rooms; plug-in component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

# ----
# Assing Window Ventilation
# Control Strategy
panel = Panel("60")
applysetpointvals = HBApplySetpointValues(room_or_program=flatten(solveadj_2.adj_rooms), cooling_setpt=panel)  # -> report, mod_obj; plug-in component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
ventcontrol = HBVentilationControl(min_in_temp="23")  # -> vent_cntrl; plug-in component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
windowopen = HBWindowOpening(rooms=flatten(applysetpointvals.mod_obj), vent_cntrl=ventcontrol)  # -> report, rooms; plug-in component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

# ----
# Request Outputs
toggle_4 = BooleanToggle(True)
simoutput = HBSimulationOutput(gains_and_losses=toggle_4, comfort_metrics=toggle_4)  # -> report, sim_output; plug-in component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
analysisperiod = LBAnalysisPeriod(start_month="6", start_day=1, start_hour=0, end_month="9")  # -> period, hoys, dates; plug-in component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
simpar = HBSimulationParameter(output=simoutput.sim_output, run_period=analysisperiod.period, timestep=6)  # -> sim_par; plug-in component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

# ----
# Download EPW File
panel_2 = Panel("https://energyplus-weather.s3.amazonaws.com/north_and_central_america_wmo_region_4/USA/MA/USA_MA_Boston-Logan.Intl.AP.725090_TMY3/USA_MA_Boston-Logan.Intl.AP.725090_TMY3.zip")
downloadepw = LBDownloadWeather(weather_URL=panel_2)  # -> epw_file, stat_file, ddy_file; plug-in component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

# ----
# Setup the Model with the Airflow Network
panel_3 = Panel("AFN_Apartment")
model = HBModel(rooms=flatten(windowopen.rooms), name=panel_3)  # -> report, model; plug-in component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
afn = HBAirflowNewtwork(model=model.model, high_rise=Toggle(True))  # -> report, model; plug-in component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

decnstrobj = HBDeconstructObject(hb_obj=windowopen.rooms)  # -> faces, apertures, doors, shades; plug-in component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
python = GhPythonScript(faces=flatten(decnstrobj.faces))  # -> report, face_ids, ext_nodes; inputs faces: list
# ---------- python: Python ----------
face_ids, ext_nodes = [], []
for face in faces:
    face_ids.append(face.identifier)
    try:
        ext_nodes.append('{}_Facade'.format(face.cardinal_direction()))
    except ZeroDivisionError:
        ext_nodes.append('Horizontal')
# ---------- end python ----------
modeltoosm = HBModelToOSM(model=afn.model, epw_file=downloadepw.epw_file, sim_par=simpar, write=Toggle(True), run="2")  # -> report, jsons, osw, osm, idf, sql, zsz, rdd, html; plug-in component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
python_2 = GhPythonScript(osm=modeltoosm.osm, face_ids=python.face_ids, ext_nodes=python.ext_nodes, run=Toggle(True))  # -> out, osm; inputs face_ids: list, ext_nodes: list, run: Boolean
# ---------- python_2: Python ----------
from ladybug_rhino.grasshopper import all_required_inputs
from ladybug_rhino.openstudio import load_osm, dump_osm, import_openstudio

OpenStudio = import_openstudio()

if all_required_inputs(ghenv.Component) and _run:
    # load the Model from the OSM
    model = load_osm(_osm)

    # add the external nodes to the model
    unique_nodes = set(_ext_nodes)
    node_map = {}
    for e_node_name in unique_nodes:
        e_node = OpenStudio.AirflowNetworkExternalNode(model)
        e_node.setName(e_node_name)
        node_map[e_node_name] = e_node

    # create a dictionary mapping surface name to external node name
    face_map = {f_id: node_map[e_node] for f_id, e_node in
                zip(_face_ids, _ext_nodes)}

    # get all of the AirflowNetworkSurfaces and set their properties
    afn_surfaces = model.getAirflowNetworkSurfaces()
    for afn_srf in afn_surfaces:
        if afn_srf.surface() and afn_srf.surface().name():
            srf_name = afn_srf.surface().name().get()
            try:
                afn_srf.setExternalNode(face_map[srf_name])
            except KeyError:
                pass  # not an opaque surface 

    # save the edited OSM over the original one
    osm = dump_osm(model, _osm)
# ---------- end python_2 ----------
toggle_5 = BooleanToggle(False)
panel_4 = Panel(python_2.osm)
runosm = HBRunOSM(osm=python_2.osm, epw_file=downloadepw.epw_file, translate=toggle_5, run=toggle_5)  # -> report, idf, sql, zsz, rdd, html; plug-in component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
